# Grasshopper definition flr_plan_gen.gh (Grasshopper 1.0.7)
# plug-ins: DotsProj

randomize = BooleanToggle(False)
path = FilePath("C:\nir_dev\MegaSavageLevel\DotsProjRh6\DotsProj\DotsProj\SourceCode\test_scripts\dots_workflow\inputs\sample1.csv")  # disabled
path_2 = FilePath("C:\nir_dev\MegaSavageLevel\DotsProjRh6\DotsProj\DotsProj\SourceCode\test_scripts\dots_workflow\inputs\sample2.csv")  # disabled
crv = Curve(<curve referenced from the Rhino model>)  # disabled
path_3 = FilePath("C:\nir_dev\MegaSavageLevel\DotsProjRh6\DotsProj\DotsProj\SourceCode\test_scripts\dots_workflow\inputs\sample2.csv")  # disabled
geo = Geometry(<curve referenced from the Rhino model>)
cbsp = CbspIndependent(
    InputFilesCsv=path,
    RotationInDegrees=Slider(0, range=0..360),
    RatioLengthWidth=Slider(0.857, range=0..2),
    RandomizedGenerations=Toggle(False),
    NumberOfOptimizationLoops=Slider(110, range=0..360))  # -> OuterBoundary, BspOutputCurves, PartitionLines; disabled
curve_skeleton = CrvSkeleton(
    InpFilePath=path_2,
    InpSiteCurve=crv,
    FromSiteOuterCirculationDepth=Slider(10, range=0..20),
    FromOuterCirculationBayDepth=Slider(50, range=0..50),
    FromBayDepthInnerCirculationDepth=Slider(13, range=0..20),
    SensitivityX100=Slider(5, range=0..5),
    OptimizationItrs=Slider(445, range=0..500))  # -> OuterOffsetCrv, InnerOffsetCrv, RESULTSegGeom; disabled
path_4 = FilePath("C:\nir_dev\MegaSavageLevel\DotsProjRh6\DotsProj\DotsProj\SourceCode\test_scripts\dots_workflow\sample2.csv")  # disabled
cbsp_site = CbspSite(
    InputFilesCsv=path_3,
    InputSiteCrv=geo,
    RotationInDegrees=Slider(0, range=0..360),
    RandomizedGenerations=randomize,
    NumberOfOptimizationLoops=Slider(1, range=1..100))  # -> SpatialCrv, CirculationLines; disabled
exploratory_mcmc = EMcMC(InpFilePath=path_4, SensitivityNumIterations=Slider(3, range=0..10), Rotation=Slider(0, range=0..360))  # disabled
geo_2 = Geometry(cbsp.OuterBoundary)
geo_3 = Geometry(cbsp.BspOutputCurves)
geo_4 = Geometry(cbsp.PartitionLines)
geo_5 = Geometry(cbsp_site.SpatialCrv)
geo_6 = Geometry(cbsp_site.CirculationLines)
crv_2 = Curve(exploratory_mcmc)
geo_7 = Geometry(curve_skeleton.OuterOffsetCrv)
geo_8 = Geometry(curve_skeleton.InnerOffsetCrv)
geo_9 = Geometry(curve_skeleton.RESULTSegGeom)
circulation = GenerateCirculation(SiteCrvOuterBoundary=geo_2, CbspCrvs=geo_3, PartitionLines=geo_4, CirculationDepth=Slider(2, range=0..2))  # -> _0PartitionLines, _1CirculationPoly, _2ResultantCbspCrv
circulation_2 = GenerateCirculation(SiteCrvOuterBoundary=geo, CbspCrvs=geo_5, PartitionLines=geo_6, CirculationDepth=Slider(2.64, range=0..10))  # -> _0PartitionLines, _1CirculationPoly, _2ResultantCbspCrv
block = MassingExtrudeBlock(
    SiteCurve=crv_2,
    Setback=Slider(3, range=0..5),
    FsrFar=Slider(2, range=0..20),
    FLRHT=Slider(5, range=0..5),
    MinCrvArea=Slider(13, range=0..20))  # -> OutputExtrudedMass, FloorCurves
geo_10 = Geometry(circulation._2ResultantCbspCrv)
geo_11 = Geometry(circulation._0PartitionLines)
geo_12 = Geometry(circulation._1CirculationPoly)
crv_3 = Curve(circulation_2._2ResultantCbspCrv)
Z = UnitZ(Factor=Slider(20, range=0..20))
extr = Extrude(Base=crv_3, Direction=Z)
