# Grasshopper definition networks.gh (Grasshopper 1.0.7)
# plug-ins: DotsProj

path = FilePath("C:\nir_dev\MegaSavageLevel\DotsProjRh6\DotsProj\DotsProj\SourceCode\test_scripts\dots_workflow\DOTS_workflow_test\inputs\network_SA.csv")
node_edge_allocation = NodeEdgeAllocation(InpFilePath=path)  # -> Debug, NodeObjects, CostObjects; disabled
panel = Panel(node_edge_allocation.Debug)
panel_2 = Panel(node_edge_allocation.NodeObjects)
panel_3 = Panel(node_edge_allocation.CostObjects)
geo = Geometry(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)
mixednet = MixedSysMain(
    NodesFromParser=node_edge_allocation.NodeObjects,
    CostFromParser=node_edge_allocation.CostObjects,
    SiteCurve=geo,
    NumberXAxis=Slider(5, range=0..20),
    NumberYAxis=Slider(2, range=0..20),
    CirculationDepth=Slider(0.91, range=0..5),
    NumberOfIterations=Slider(100, range=0..100),
    MinimumAreaOfCurve=Slider(67, range=0..150))  # -> DebugText, NodeGeometryOutput, Curve
geo_2 = Geometry(mixednet.Curve)
panel_4 = Panel(mixednet.NodeGeometryOutput)
panel_5 = Panel(mixednet.DebugText)
number_slider = Slider(0, range=0..150)
block = MassingExtrudeBlock(
    SiteCurve=geo_2,
    Setback=Slider(0.607, range=0..5),
    FsrFar=panel_4,
    FLRHT=Slider(4.715, range=0..5),
    MinCrvArea=Slider(0, range=0..150))  # -> OutputMassingBreps, OutputFloorCurves
staggered_courtyard_interp = StaggeredCourtyardInterpolated(
    Site=geo_2,
    Setback=Slider(0.607, range=0..5),
    BaseDepthOffset=Slider(2.299, range=0..5),
    NumOfTowerFootprintsBaseCrvSubdiv=Slider(5, range=0..5),
    NumberOfTowers=Slider(2, range=0..5),
    FloorFloorHeight=Slider(1.015, range=0..5),
    BaseFSRFAR=panel_4,
    TowerFSRFAR=panel_4,
    MinimumAreaSiteCrv=number_slider,
    MinimumAreaTowerCrv=number_slider)  # -> OffsetCurve, BaseFloorCurves, TowerFloorCurves, PolyFromSubDivOfCrvs, FinalBoundaryRepresentation; disabled
courtyard_mass = CourtyardMassing(
    SiteCurve=geo_2,
    FSRFAR=panel_4,
    FloorHeight=Slider(0.607, range=0..5),
    Setback=Slider(0.607, range=0..5),
    BayDepth=Slider(1.015, range=0..5),
    MinFloorArea=Slider(0, range=0..150))  # -> OutputFloorCurves, OutputMassingBreps; disabled
staggered_mass = StaggeredMassing(
    SiteCurve=geo_2,
    FloorHeightRequired=panel_4,
    SetbackStepbacksForMassing="0.5,0.7",
    HeightsCorrespondingToStepbacks="1,3",
    MinArea=Slider(0, range=0..150))  # -> OutputFloorCurves, OutputMassingBreps, OutputTextPanelTotalFSRGFAAchieved, NumberOfFloors; disabled
geo_3 = Geometry(block.OutputMassingBreps)

crv = Curve(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)
pt = Point([Point(-19, 19, 0), Point(13, 7, 0), Point(-2, -15.26724933, 0)])
grid_gen = SpaceGenerator(InputCurve=crv, OriginPoints=pt, SegmentLength=Slider(4, range=0..35), IterationNumber=Slider(10000, range=0..10000))  # -> DebugText, SpaceCurves
crv_2 = Curve(grid_gen.SpaceCurves)
