# Grasshopper definition openCrvTest.gh (Grasshopper 1.0.7)
# plug-ins: DotsProj

geo = Geometry(<curve referenced from the Rhino model>)
path = FilePath("C:\nir_dev\MegaSavageLevel\DotsProjRh6\DotsProj\DotsProj\SourceCode\TEST_SCRIPTS\dots_workflow\DOTS_workflow_test\inputs\sample1.csv")
path_2 = FilePath("C:\nir_dev\MegaSavageLevel\DotsProjRh6\DotsProj\DotsProj\SourceCode\test_scripts\dots_workflow\DOTS_workflow_test\inputs\sample1.csv")
geo_2 = Geometry(<curve referenced from the Rhino model>)
oc_linear = OpenCurveLinear(InpFilePath=path, BayDepth=Slider(30, range=0..30), BaseCurve=geo, NumberIterations=Slider(100, range=0..100))  # -> DebugText, SpacesGeom, DistributedPts, SpacesCrvs; disabled
oc_double = OpenCurveDouble(
    InpFilePath=path_2,
    BayDepth=Slider(30, range=0..30),
    CorridorDepth=Slider(8.026, range=0..30),
    BaseCurve=geo_2,
    NumberOfIterations=Slider(237.565, range=0..400))  # -> DebugText, SpacesGeom, CellsPoly, SpacesCrvs; disabled
crv = Curve(oc_linear.SpacesGeom)
Z = UnitZ(Factor=Slider(30, range=0..30))
extr = Extrude(Base=crv, Direction=Z)
geo_3 = Geometry(oc_double.SpacesCrvs)
Z_2 = UnitZ(Factor=Slider(30, range=0..30))
extr_2 = Extrude(Base=geo_3, Direction=Z_2)
