# Grasshopper definition urban_plan_gen.gh (Grasshopper 1.0.7)
# plug-ins: DotsProj

crv = Curve(<curve referenced from the Rhino model>)  # disabled
crv_2 = Curve(<curve referenced from the Rhino model>)  # disabled
timer = Timer(TimerInterval=1000)  # disabled
parcel_subdiv_diff = ParcelsBySubdivisionWithSubtraction(
    InputSite=crv_2,
    InternalCrv=crv,
    NumOfParcels=Slider(20, range=0..20),
    DevMean01=Slider(0, range=0..1),
    AngleAlignmentDegrees0360=Slider(0, range=0..360),
    ShowThisIterations=Slider(1, range=0..20),
    ResetAllValues=Toggle(True),
    Generate=Toggle(True))  # -> LowestDeviationOfParcelSolution, StreetCenterLines, OutputParcelFromRequiredIteration, OutputStreetFromRequiredIteration, NumberOfResults; disabled
crv_3 = Curve(parcel_subdiv_diff.LowestDeviationOfParcelSolution)
panel = Panel(parcel_subdiv_diff.NumberOfResults)
crv_4 = Curve(parcel_subdiv_diff.StreetCenterLines)
crv_5 = Curve(parcel_subdiv_diff.OutputParcelFromRequiredIteration)
crv_6 = Curve(parcel_subdiv_diff.OutputStreetFromRequiredIteration)
circulation = GenerateCirculation(SiteCrvOuterBoundary=crv_2, CbspCrvs=crv_3, PartitionLines=crv_4, CirculationDepth=Slider(15.502, range=0..20))  # -> _0PartitionLines, _1CirculationPoly, _2ResultantCbspCrv; disabled
crv_7 = Curve(circulation._0PartitionLines)
crv_8 = Curve(circulation._2ResultantCbspCrv)
block = ExtrudeBlock(
    SiteCurve=crv_8,
    Setback=Slider(6.66, range=0..20),
    FsrFar=Slider(20, range=0..20),
    FLRHT=Slider(0.715, range=0..20),
    MinCrvArea=Slider(100, range=0..100))  # -> OutputExtrudedMass, FloorCurves
geo = Geometry(block.FloorCurves)
geo_2 = Geometry(block.OutputExtrudedMass)

crv_9 = Curve(<curve referenced from the Rhino model>)  # disabled
crv_10 = Curve(<curve referenced from the Rhino model>)  # disabled
parcel_int_poly = ParcelsFromInternalPoly(InputSiteCurve=crv_10, InternalPolyine=crv_9)  # -> OutputParcels, OutputStreets; disabled
crv_11 = Curve(parcel_int_poly.OutputStreets)
crv_12 = Curve(parcel_int_poly.OutputParcels)
circulation_2 = GenerateCirculation(SiteCrvOuterBoundary=crv_10, CbspCrvs=crv_12, PartitionLines=crv_11, CirculationDepth=Slider(4.972, range=0..10))  # -> _0PartitionLines, _1CirculationPoly, _2ResultantCbspCrv
crv_13 = Curve(circulation_2._0PartitionLines)
crv_14 = Curve(circulation_2._2ResultantCbspCrv)
block_2 = ExtrudeBlock(
    SiteCurve=crv_14,
    Setback=Slider(1.416, range=0..20),
    FsrFar=Slider(1.811, range=0..20),
    FLRHT=Slider(3.819, range=0..20),
    MinCrvArea=Slider(106.409, range=0..200))  # -> OutputExtrudedMass, FloorCurves
geo_3 = Geometry(block_2.FloorCurves)
geo_4 = Geometry(block_2.OutputExtrudedMass)

crv_15 = Curve([<curve referenced from the Rhino model> x295])
ext_setbacks = UrbanMassingFromSiteFsrSetbacksStreets(
    InputSiteCurves=crv_15,
    StreetLayerNames="streeta, streetb",
    CorrespondingStreetSetbacks="5.5, 15.0",
    InputFSR=Slider(15, range=0..15))  # -> OutputSolidGeometry, OutputSITENumbers
geo_5 = Geometry(ext_setbacks.OutputSolidGeometry)
panel_2 = Panel(ext_setbacks.OutputSITENumbers)

crv_16 = Curve(<curve referenced from the Rhino model>)

crv_17 = Curve(<curve referenced from the Rhino model>)  # disabled
peripheral_subdiv_parcel = PeripheralSubdivisionParcels(
    SiteCurve=crv_17,
    SetbackDimensionFromSite=Slider(9, range=0..20),
    BayDepthFromSetback=Slider(103, range=0..300),
    InnerCrv0ffsetFromBay=Slider(15, range=0..20),
    NumDiv=Slider(9, range=0..20))  # -> Setback, Bay, InnerCrv, ParcelCrv; disabled
number_slider = Slider(0, range=0..1)
crv_18 = Curve(peripheral_subdiv_parcel.ParcelCrv)
block_3 = ExtrudeBlock(
    SiteCurve=crv_18,
    Setback=Slider(15.316, range=0..20),
    FsrFar=Slider(20, range=0..20),
    FLRHT=Slider(5.827, range=0..20),
    MinCrvArea=Slider(0, range=0..20000))  # -> OutputExtrudedMass, FloorCurves
geo_6 = Geometry(block_3.OutputExtrudedMass)
geo_7 = Geometry(block_3.FloorCurves)  # disabled

timer_2 = Timer(TimerInterval=1000, Target=parcel_subdiv)
parcel_subdiv = ParcelsBySubdivision(
    InputSite=crv_16,
    NumOfParcels=Slider(64, range=0..100),
    DevMean01=Slider(0.121, range=0..1),
    AngleAlignmentDegrees0360=Slider(360, range=0..360),
    ShowThisIterations=Slider(0, range=0..33),
    ResetAllValues=Toggle(True),
    Generate=Toggle(True))  # -> LowestDeviationOfParcelSolution, StreetCenterLines, OutputParcelFromRequiredIteration, OutputStreetFromRequiredIteration, NumberOfResults

crv_19 = Curve([<curve referenced from the Rhino model> x2])
peripheral_subdiv_parcel_2 = PeripheralSubdivisionParcels(
    SiteCurve=crv_19,
    SetbackDimensionFromSite=Slider(1.561, range=0..20),
    BayDepthFromSetback=Slider(4.332, range=0..10),
    InnerCrv0ffsetFromBay=Slider(2.463, range=0..10),
    NumDiv=Slider(40, range=0..100))  # -> Setback, Bay, InnerCrv, ParcelCrv
crv_20 = Curve(peripheral_subdiv_parcel_2.Setback)
crv_21 = Curve(peripheral_subdiv_parcel_2.Bay)
crv_22 = Curve(peripheral_subdiv_parcel_2.InnerCrv)
crv_23 = Curve(peripheral_subdiv_parcel_2.ParcelCrv)

crv_24 = Curve(<curve referenced from the Rhino model>)  # disabled
peripheral_subdiv_parcel_3 = PeripheralSubdivisionParcels(
    SiteCurve=crv_24,
    SetbackDimensionFromSite=Slider(3, range=0..10),
    BayDepthFromSetback=Slider(47.407, range=0..50),
    InnerCrv0ffsetFromBay=Slider(1.573, range=0..10),
    NumDiv=Slider(15, range=0..100))  # -> Setback, Bay, InnerCrv, ParcelCrv; disabled
crv_25 = Curve(peripheral_subdiv_parcel_3.Setback)
crv_26 = Curve(peripheral_subdiv_parcel_3.Bay)
crv_27 = Curve(peripheral_subdiv_parcel_3.InnerCrv)
crv_28 = Curve(peripheral_subdiv_parcel_3.ParcelCrv)
crv_29 = Curve(crv_28)
courtyard_mass = CourtyardMassing(
    SiteCurve=crv_29,
    FSRFAR=Slider(2.198, range=0.5..3),
    FloorHeight=Slider(3, range=0..10),
    Setback=Slider(2.957, range=0..25),
    BayDepth=Slider(8, range=0..20),
    MaxHtFloorArea=Slider(0, range=0..20))  # -> OutputFloorCurves, OutputMassingBreps

crv_30 = Curve(parcel_subdiv.StreetCenterLines)
crv_31 = Curve(parcel_subdiv.OutputParcelFromRequiredIteration)
crv_32 = Curve(parcel_subdiv.LowestDeviationOfParcelSolution)
crv_33 = Curve(parcel_subdiv.OutputStreetFromRequiredIteration)
panel_3 = Panel(parcel_subdiv.NumberOfResults)
circulation_3 = GenerateCirculation(SiteCrvOuterBoundary=crv_16, CbspCrvs=crv_32, PartitionLines=crv_30, CirculationDepth=Slider(9, range=0..100))  # -> _0PartitionLines, _1CirculationPoly, _2ResultantCbspCrv
crv_34 = Curve(crv_32)
geo_8 = Geometry(circulation_3._2ResultantCbspCrv)
select = Select(
    InputSiteCrv=crv_16,
    Parcels=circulation_3._2ResultantCbspCrv,
    CentralizeOrDisperse=Toggle(False),
    OpenSpaceRequirement=Slider(7.964, range=0..100))  # -> OutputBuildableParcels, OutputOpenSpaceParcels
crv_35 = Curve(select.OutputBuildableParcels)
crv_36 = Curve(select.OutputOpenSpaceParcels)

number_slider_2 = Slider(0, range=0..1)
crv_37 = Curve(crv_23)  # disabled
block_4 = ExtrudeBlock(
    SiteCurve=crv_37,
    Setback=Slider(1.156, range=0..20),
    FsrFar=Slider(7.892, range=0..20),
    FLRHT=Slider(0.608, range=0..20),
    MinCrvArea=Slider(0, range=0..20000))  # -> OutputExtrudedMass, FloorCurves; disabled
geo_9 = Geometry(block_4.OutputExtrudedMass)
geo_10 = Geometry(block_4.FloorCurves)

block_5 = ExtrudeBlock(
    SiteCurve=crv_35,
    Setback=Slider(7.987, range=0..20),
    FsrFar=Slider(2.427, range=0..20),
    FLRHT=Slider(3.029, range=0..20),
    MinCrvArea=Slider(97.433, range=0..1500))  # -> OutputExtrudedMass, FloorCurves
courtyard_mass_2 = CourtyardMassing(
    SiteCurve=crv_35,
    FSRFAR=Slider(7.987, range=0..20),
    FloorHeight=Slider(20, range=0..20),
    Setback=Slider(1.64, range=0..20),
    BayDepth=Slider(44.308, range=0..100),
    MinFloorArea=Slider(0, range=0..1500))  # -> OutputFloorCurves, OutputMassingBreps
geo_11 = Geometry(block_5.FloorCurves)
geo_12 = Geometry(block_5.OutputExtrudedMass)
geo_13 = Geometry(courtyard_mass_2.OutputMassingBreps)

crv_38 = Curve(<curve referenced from the Rhino model>)  # disabled
peripheral_subdiv_parcel_4 = PeripheralSubdivisionParcels(
    SiteCurve=crv_38,
    SetbackDimensionFromSite=Slider(3, range=0..10),
    BayDepthFromSetback=Slider(47.407, range=0..50),
    InnerCrv0ffsetFromBay=Slider(1.573, range=0..10),
    NumDiv=Slider(15, range=0..100))  # -> Setback, Bay, InnerCrv, ParcelCrv; disabled
number_slider_3 = Slider(0, range=0..20)
crv_39 = Curve(peripheral_subdiv_parcel_4.Setback)
crv_40 = Curve(peripheral_subdiv_parcel_4.Bay)
crv_41 = Curve(peripheral_subdiv_parcel_4.InnerCrv)
crv_42 = Curve(peripheral_subdiv_parcel_4.ParcelCrv)
number_slider_4 = Slider(20, range=0..20)
number_slider_5 = Slider(4, range=0..20)
number_slider_6 = Slider(2.198, range=0.5..3)
number_slider_7 = Slider(9.613, range=0..25)
number_slider_8 = Slider(3, range=0..10)
number_slider_9 = Slider(0.149, range=0..10)
number_slider_10 = Slider(0.726, range=0..5)
crv_43 = Curve(crv_42)
staggered_courtyard_normal = StaggeredCourtyardNormal(
    Site=crv_43,
    Setback=number_slider_10,
    BaseDepthOffset=number_slider_7,
    NumOfTowerFootprintsBaseCrvSubdiv=number_slider_4,
    NumberOfTowers=number_slider_5,
    FloorFloorHeight=number_slider_8,
    BaseFSRFAR=number_slider_6,
    TowerFSRFAR=number_slider_9,
    MinimumAreaSiteCrv=number_slider_3,
    MinimumAreaTowerCrv=number_slider_3)  # -> OffsetCurve, BaseFloorCurves, TowerFloorCurves, PolyFromSubDivOfCrvs, FinalBoundaryRepresentation; disabled
staggered_courtyard_interp = StaggeredCourtyardInterpolated(
    Site=crv_43,
    Setback=number_slider_10,
    BaseDepthOffset=number_slider_7,
    BaseDepthOffset_2=number_slider_4,
    NumberOfTowers=number_slider_5,
    FloorFloorHeight=number_slider_8,
    BaseFSRFAR=number_slider_6,
    TowerFSRFAR=number_slider_9,
    MinimumAreaSiteCrv=number_slider_3,
    MinimumAreaTowerCrv=number_slider_3)  # -> OffsetCurve, BaseFloorCurves, TowerFloorCurves, PolyFromSubDivOfCrvs, FinalBoundaryRepresentation; disabled
geo_14 = Geometry(staggered_courtyard_normal.FinalBoundaryRepresentation)
geo_15 = Geometry(staggered_courtyard_interp.FinalBoundaryRepresentation)
