# Grasshopper definition Rush_workFlow.gh (Grasshopper 1.0.7)
# plug-ins: DotsProj

path = FilePath("C:\nir_dev\MegaSavageLevel\rush\inputsToDots\rushPeripheralInput.csv")
geo = Geometry(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)
curve_skeleton = CrvSkeleton(
    InpFilePath=path,
    InpSiteCurve=geo,
    FromSiteOuterCirculationDepth=Slider(5.624, range=0..25),
    FromOuterCirculationBayDepth=Slider(20.823, range=0..25),
    FromBayDepthInnerCirculationDepth=Slider(5.317, range=0..25),
    SensitivityX100=Slider(2, range=0..10),
    OptimizationItrs=Slider(1, range=0..100))  # -> OuterOffsetCrv, InnerOffsetCrv, RESULTSegGeom, DebugString
geo_2 = Geometry(curve_skeleton.RESULTSegGeom)
Z = UnitZ(Factor=Slider(5.317, range=0..25))
extr = Extrude(Base=geo_2, Direction=Z)
path_2 = FilePath("C:\nir_dev\MegaSavageLevel\DotsProjRh6\DotsProj\DotsProj\SourceCode\TEST_SCRIPTS\dots_workflow\DOTS_workflow_test\rush\inputsToDots\rushIntermediateZoneInput.csv")
geo_3 = Geometry(curve_skeleton.InnerOffsetCrv)
number_slider = Slider(3, range=0..3)
radial_zone_core = RadialZoneCore(
    InputFilesCsv=path_2,
    InputSiteCrv=geo_3,
    CoreArea=Slider(1590.985, range=0..3000),
    MoveCoreHorizontal=Slider(-0.288, range=-25..25.001),
    MoveCoreVertical=Slider(0.608, range=-25..25),
    CoreAspectRatio=Slider(1.089, range=0.01..2),
    RotationInDegrees=Slider(0, range=0..360))  # -> CoreCrv, ZoneCrvsRad, ZoneCrvsNor, DebugText
Z_2 = UnitZ(Factor=Slider(14.067, range=0..25))
geo_4 = Geometry(radial_zone_core.CoreCrv)
geo_5 = Geometry(radial_zone_core.ZoneCrvsRad)
geo_6 = Geometry(radial_zone_core.ZoneCrvsNor)
item = ListItem(List=geo_6, Index=number_slider, Wrap=True)
extr_2 = Extrude(Base=item, Direction=Z_2)
Z_3 = UnitZ(Factor=Slider(17.005, range=0..25))
item_2 = ListItem(List=geo_5, Index=number_slider, Wrap=True)
item_3 = ListItem(Index=number_slider, Wrap=True)
extr_3 = Extrude(Base=item_2, Direction=Z_3)
geo_7 = Geometry(item_3)
