# Grasshopper definition flr_plan_gen.gh (Grasshopper 1.0.7)
# plug-ins: DotsProj

path = FilePath("C:\nir_dev\MegaSavageLevel\DotsProjRh6\DotsProj\DotsProj\SourceCode\TEST_SCRIPTS\dots_workflow\DOTS_workflow_test\inputs\sample1.csv")
crv = Curve(<curve referenced from the Rhino model>)
crv_skeleton = CrvSkeleton(
    InpFilePath=path,
    InpSiteCurve=crv,
    FromSiteOuterCirculationDepth=Slider(10, range=0..20),
    FromOuterCirculationBayDepth=Slider(49, range=0..50),
    FromBayDepthInnerCirculationDepth=Slider(20, range=0..20),
    SensitivityX100=Slider(5, range=0..5),
    OptimizationItrs=Slider(0, range=0..500))  # -> OuterOffsetCrv, InnerOffsetCrv, RESULTSegGeom, CrvNamesColor
Z = UnitZ(Factor=Slider(80, range=0..500))
geo = Geometry(crv_skeleton.OuterOffsetCrv)
geo_2 = Geometry(crv_skeleton.InnerOffsetCrv)
geo_3 = Geometry(crv_skeleton.RESULTSegGeom)
path_2 = FilePath("C:\nir_dev\MegaSavageLevel\DotsProjRh6\DotsProj\DotsProj\SourceCode\TEST_SCRIPTS\dots_workflow\DOTS_workflow_test\inputs\sample1.csv")
randomize = BooleanToggle(False)
path_3 = FilePath("C:\nir_dev\MegaSavageLevel\DotsProjRh6\DotsProj\DotsProj\SourceCode\TEST_SCRIPTS\dots_workflow\DOTS_workflow_test\inputs\colors.csv")
cbsp_site = CbspSite(
    InputFilesCsv=path_2,
    InputSiteCrv=geo_2,
    RotationInDegrees=Slider(0, range=0..360),
    RandomizedGenerations=randomize,
    NumberOfOptimizationLoops=Slider(12, range=1..100))  # -> SpatialCrv, CirculationLines, DebugText; disabled
color_input = ColorInput(InpFilePath=path_3, ListSpaceKeys=crv_skeleton.CrvNamesColor, ListSpaceCrvs=geo_3)  # -> BrepFromCrvs, ColorStr
geo_4 = Geometry(cbsp_site.CirculationLines)
geo_5 = Geometry(cbsp_site.SpatialCrv)
panel = Panel(cbsp_site.DebugText)
custom_preview = CustomPreview(Geometry=color_input.BrepFromCrvs, Material=color_input.ColorStr)
circulation = GenerateCirculation(SiteCrvOuterBoundary=geo_2, CbspCrvs=geo_5, PartitionLines=geo_4, CirculationDepth=Slider(5.069, range=0..10))  # -> _0PartitionLines, _1CirculationPoly, _2ResultantCbspCrv; disabled
Z_2 = UnitZ(Factor=Slider(6.712, range=0..10))
geo_6 = Geometry(circulation._0PartitionLines)
geo_7 = Geometry(circulation._2ResultantCbspCrv)
extr = Extrude(Base=[geo_7, geo_2, geo_3], Direction=Z_2)

path_4 = FilePath("C:\nir_dev\MegaSavageLevel\DotsProjRh6\DotsProj\DotsProj\SourceCode\TEST_SCRIPTS\dots_workflow\DOTS_workflow_test\inputs\sample1.csv")
crv_2 = Curve(<curve referenced from the Rhino model>)
radial_zone_core = RadialZoneCore(
    InputFilePath=path_4,
    InputSiteCrv=crv_2,
    CoreArea=Slider(1000, range=0..1000),
    MoveCoreHorizontal=Slider(0, range=0..100),
    MoveCoreVertical=Slider(0, range=0..100),
    CoreAspectRatio=Slider(0.869, range=0..1),
    RotationInDegrees=Slider(0, range=0..360))  # -> CoreCrv, ZoneCrvsRad, CrvNamesColor
crv_3 = Curve(radial_zone_core.CoreCrv)
path_5 = FilePath("C:\nir_dev\MegaSavageLevel\DotsProjRh6\DotsProj\DotsProj\SourceCode\TEST_SCRIPTS\dots_workflow\DOTS_workflow_test\inputs\colors.csv")
color_input_2 = ColorInput(InpFilePath=path_5, ListSpaceKeys=radial_zone_core.CrvNamesColor, ListSpaceCrvs=radial_zone_core.ZoneCrvsRad)  # -> BrepFromCrvs, ColorStr
custom_preview_2 = CustomPreview(Geometry=color_input_2.BrepFromCrvs, Material=color_input_2.ColorStr)

randomize_2 = BooleanToggle(False)
path_6 = FilePath("C:\nir_dev\MegaSavageLevel\DotsProjRh6\DotsProj\DotsProj\SourceCode\TEST_SCRIPTS\dots_workflow\DOTS_workflow_test\inputs\sample1.csv")
geo_8 = Geometry(<curve referenced from the Rhino model>)
cbsp_site_2 = CbspSite(
    InputFilePath=path_6,
    InputSiteCrv=geo_8,
    RotationInDegrees=Slider(0, range=0..360),
    RandomizedGenerations=randomize_2,
    NumberOfOptimizationLoops=Slider(1, range=1..100))  # -> SpatialCrv, CirculationLines, CrvNamesColor
panel_2 = Panel(cbsp_site_2.CrvNamesColor)
geo_9 = Geometry(cbsp_site_2.SpatialCrv)
geo_10 = Geometry(cbsp_site_2.CirculationLines)
circulation_2 = GenerateCirculation(SiteCrvOuterBoundary=geo_8, CbspCrvs=geo_9, PartitionLines=geo_10, CirculationDepth=Slider(6.712, range=0..10))  # -> _0PartitionLines, _1CirculationPoly, _2ResultantCbspCrv
path_7 = FilePath("C:\nir_dev\MegaSavageLevel\DotsProjRh6\DotsProj\DotsProj\SourceCode\TEST_SCRIPTS\dots_workflow\DOTS_workflow_test\inputs\colors.csv")
geo_11 = Geometry(circulation_2._2ResultantCbspCrv)
color_input_3 = ColorInput(InpFilePath=path_7, ListSpaceKeys=cbsp_site_2.CrvNamesColor, ListSpaceCrvs=geo_11)  # -> BrepFromCrvs, ColorStr
geo_12 = Geometry(circulation_2._0PartitionLines)
custom_preview_3 = CustomPreview(Geometry=color_input_3.BrepFromCrvs, Material=color_input_3.ColorStr)

path_8 = FilePath("C:\nir_dev\MegaSavageLevel\DotsProjRh6\DotsProj\DotsProj\SourceCode\TEST_SCRIPTS\dots_workflow\DOTS_workflow_test\inputs\sample1.csv")
cbsp = CbspIndependent(
    InputFilesCsv=path_8,
    RotationInDegrees=Slider(0, range=0..360),
    RatioLengthWidth=Slider(0.659, range=0..2),
    RandomizedGenerations=Toggle(False),
    NumberOfOptimizationLoops=Slider(262, range=0..360))  # -> OuterBoundary, BspOutputCurves, PartitionLines, CrvNamesColor
geo_13 = Geometry(cbsp.OuterBoundary)
geo_14 = Geometry(cbsp.BspOutputCurves)
geo_15 = Geometry(cbsp.PartitionLines)
path_9 = FilePath("C:\nir_dev\MegaSavageLevel\DotsProjRh6\DotsProj\DotsProj\SourceCode\TEST_SCRIPTS\dots_workflow\DOTS_workflow_test\inputs\colors.csv")
circulation_3 = GenerateCirculation(SiteCrvOuterBoundary=geo_13, CbspCrvs=geo_14, PartitionLines=geo_15, CirculationDepth=Slider(2, range=0..2))  # -> _0PartitionLines, _1CirculationPoly, _2ResultantCbspCrv; disabled
color_input_4 = ColorInput(InpFilePath=path_9, ListSpaceKeys=cbsp.CrvNamesColor, ListSpaceCrvs=geo_14)  # -> BrepFromCrvs, ColorStr
geo_16 = Geometry(circulation_3._2ResultantCbspCrv)
geo_17 = Geometry(circulation_3._0PartitionLines)
geo_18 = Geometry(circulation_3._1CirculationPoly)
custom_preview_4 = CustomPreview(Geometry=color_input_4.BrepFromCrvs, Material=color_input_4.ColorStr)
Z_3 = UnitZ(Factor=Slider(1.504, range=0..20))
extr_2 = Extrude(Direction=Z_3)

pt = Point(Point(162.2521564, 9.998312688, 0))
path_10 = FilePath("C:\nir_dev\MegaSavageLevel\DotsProjRh6\DotsProj\DotsProj\SourceCode\TEST_SCRIPTS\dots_workflow\DOTS_workflow_test\inputs\sample1.csv")
emcmc = EMcMC(
    InpFilePath=path_10,
    InitialPoint=pt,
    SensitivityNumIterations=Slider(7, range=0..10),
    Rotation=Slider(84.49, range=0..360))  # -> CrvNamesColor, SpatialCrvs
path_11 = FilePath("C:\nir_dev\MegaSavageLevel\DotsProjRh6\DotsProj\DotsProj\SourceCode\TEST_SCRIPTS\dots_workflow\DOTS_workflow_test\inputs\colors.csv")
color_input_5 = ColorInput(InpFilePath=path_11, ListSpaceKeys=emcmc.CrvNamesColor, ListSpaceCrvs=emcmc.SpatialCrvs)  # -> BrepFromCrvs, ColorStr
sel_sides = SelectSidesFromPolyline(OffsetIndexStart=Slider(0, range=0..10), NumOfSides=Slider(3, range=0..10))
Z_4 = UnitZ(Factor=Slider(3, range=0..10))
crv_4 = Curve(sel_sides)
custom_preview_5 = CustomPreview(Geometry=color_input_5.BrepFromCrvs, Material=color_input_5.ColorStr)
extr_3 = Extrude(Direction=Z_4)
