# Grasshopper definition networks.gh (Grasshopper 1.0.7)
# plug-ins: DotsProj

path = FilePath("C:\nir_dev\MegaSavageLevel\DotsProjRh6\DotsProj\DotsProj\SourceCode\test_scripts\dots_workflow\DOTS_workflow_test\inputs\network_SA.csv")
node_edge_allocation = NodeEdgeAllocation(InpFilePath=path)  # -> Debug, NodeObjects, CostObjects; disabled
panel = Panel(node_edge_allocation.Debug)
panel_2 = Panel(node_edge_allocation.NodeObjects)
panel_3 = Panel(node_edge_allocation.CostObjects)
geo = Geometry(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)
mixednet = MixedSysMain(
    NodesFromParser=node_edge_allocation.NodeObjects,
    CostFromParser=node_edge_allocation.CostObjects,
    SiteCurve=geo,
    NumberXAxis=Slider(5, range=0..20),
    NumberYAxis=Slider(2, range=0..20),
    CirculationDepth=Slider(0.91, range=0..5),
    NumberOfIterations=Slider(100, range=0..100),
    MinimumAreaOfCurve=Slider(67, range=0..150))  # -> DebugText, NodeGeometryOutput, Curve
geo_2 = Geometry(mixednet.Curve)
panel_4 = Panel(mixednet.NodeGeometryOutput)
panel_5 = Panel(mixednet.DebugText)
number_slider = Slider(0, range=0..150)
block = MassingExtrudeBlock(
    SiteCurve=geo_2,
    Setback=Slider(0.607, range=0..5),
    FsrFar=panel_4,
    FLRHT=Slider(4.715, range=0..5),
    MinCrvArea=Slider(0, range=0..150))  # -> OutputMassingBreps, OutputFloorCurves
staggered_courtyard_interp = StaggeredCourtyardInterpolated(
    Site=geo_2,
    Setback=Slider(0.607, range=0..5),
    BaseDepthOffset=Slider(2.299, range=0..5),
    NumOfTowerFootprintsBaseCrvSubdiv=Slider(5, range=0..5),
    NumberOfTowers=Slider(2, range=0..5),
    FloorFloorHeight=Slider(1.015, range=0..5),
    BaseFSRFAR=panel_4,
    TowerFSRFAR=panel_4,
    MinimumAreaSiteCrv=number_slider,
    MinimumAreaTowerCrv=number_slider)  # -> OffsetCurve, BaseFloorCurves, TowerFloorCurves, PolyFromSubDivOfCrvs, FinalBoundaryRepresentation; disabled
courtyard_mass = CourtyardMassing(
    SiteCurve=geo_2,
    FSRFAR=panel_4,
    FloorHeight=Slider(0.607, range=0..5),
    Setback=Slider(0.607, range=0..5),
    BayDepth=Slider(1.015, range=0..5),
    MinFloorArea=Slider(0, range=0..150))  # -> OutputFloorCurves, OutputMassingBreps; disabled
staggered_mass = StaggeredMassing(
    SiteCurve=geo_2,
    FloorHeightRequired=panel_4,
    SetbackStepbacksForMassing="0.5,0.7",
    HeightsCorrespondingToStepbacks="1,3",
    MinArea=Slider(0, range=0..150))  # -> OutputFloorCurves, OutputMassingBreps, OutputTextPanelTotalFSRGFAAchieved, NumberOfFloors; disabled
geo_3 = Geometry(block.OutputMassingBreps)

crv = Curve(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)
pt = Point(Point(16.89929088, -13.84363355, 0))
grid_gen = SpaceGenerator(
    InputCurve=crv,
    OriginPoints=pt,
    SegmentLength=Slider(35, range=0..35),
    IterationNumber=Slider(50000, range=0..50000),
    RndAngleRadians=Slider(0, range=0..6.28))  # -> DebugText, SpaceCurves
crv_2 = Curve(grid_gen.SpaceCurves)
Z = UnitZ(Factor=Slider(6.28, range=0..6.28))
extr = Extrude(Base=crv_2, Direction=Z)
gen_2_parcels = Generator2Parcels(
    SpaceCurveSegements=crv_2,
    Setback=Slider(2.236, range=0..6.28),
    BayDepth=Slider(6.28, range=0..6.28),
    GenerateIndividualParcels=Toggle(True),
    ParcelWidth=Slider(16.908, range=0..20))  # -> DebugText, CirculationPath, ParcelCurves, ParcelRegion, DebugCrv
item = ListItem(List=crv_2, Index=Slider(3, range=0..35), Wrap=True)
geo_4 = Geometry(gen_2_parcels.DebugCrv)  # disabled
crv_3 = Curve(gen_2_parcels.ParcelCurves)
crv_4 = Curve(gen_2_parcels.ParcelRegion)
crv_5 = Curve(gen_2_parcels.CirculationPath)
block_2 = MassingExtrudeBlock(
    SiteCurve=crv_3,
    Setback=Slider(0.871, range=0..6.28),
    FsrFar=Slider(6.28, range=0..6.28),
    FLRHT=Slider(6.28, range=0..6.28),
    MinCrvArea=Slider(3.145, range=0..6.28))  # -> OutputMassingBreps, OutputFloorCurves
