# Grasshopper definition masing.gh (Grasshopper 1.0.7)
# plug-ins: DotsProj

crv = Curve(<curve referenced from the Rhino model>)  # disabled
crv_2 = Curve(<curve referenced from the Rhino model>)
crv_3 = Curve(<curve referenced from the Rhino model>)  # disabled
crv_4 = Curve(<curve referenced from the Rhino model>)  # disabled
crv_5 = Curve(<curve referenced from the Rhino model>)  # disabled
block = MassingExtrudeBlock(
    SiteCurve=crv,
    Setback=Slider(63.267, range=0..255),
    FsrFar=Slider(10.796, range=0..25),
    FLRHT=Slider(6.701, range=0..25),
    MinCrvArea=Slider(5, range=0..5))  # -> OutputMassingBreps, OutputFloorCurves; disabled
staggered_courtyard_normal = StaggeredCourtyardNormal(
    Site=crv_3,
    Setback=Slider(10, range=0..10),
    BaseDepthOffset=Slider(89.905, range=0..150),
    NumOfTowerFootprintsBaseCrvSubdiv=Slider(16, range=0..25),
    NumberOfTowers=Slider(2, range=0..10),
    FloorFloorHeight=Slider(8.166, range=0..10),
    BaseFSRFAR=Slider(4.691, range=0..10),
    TowerFSRFAR=Slider(10, range=0..10),
    MinimumAreaSiteCrv=Slider(0, range=0..5),
    MinimumAreaTowerCrv=Slider(0.053, range=0..5))  # -> OffsetCurve, BaseFloorCurves, TowerFloorCurves, PolyFromSubDivOfCrvs, FinalBoundaryRepresentation
courtyard_mass = CourtyardMassing(
    SiteCurve=crv_2,
    FSRFAR=Slider(3.988, range=0..10),
    FloorHeight=Slider(25, range=0..25),
    Setback=Slider(25, range=0..25),
    BayDepth=Slider(66.071, range=0..100),
    MinFloorArea=Slider(0, range=0..5))  # -> OutputFloorCurves, OutputMassingBreps
staggered_mass = StaggeredMassing(
    SiteCurve=crv_4,
    FloorHeightRequired=Slider(5, range=0..10),
    SetbackStepbacksForMassing="10.0,15,17.5,21",
    HeightsCorrespondingToStepbacks="15, 20, 25, 30",
    MinArea=Slider(4.592, range=0..10))  # -> OutputFloorCurves, OutputMassingBreps, OutputTextPanelTotalFSRGFAAchieved, NumberOfFloors; disabled
staggered_courtyard_interp = StaggeredCourtyardInterpolated(
    Site=crv_5,
    Setback=Slider(8.628, range=0..10),
    BaseDepthOffset=Slider(65.347, range=0..100),
    NumOfTowerFootprintsBaseCrvSubdiv=Slider(10, range=0..10),
    NumberOfTowers=Slider(3, range=0..10),
    FloorFloorHeight=Slider(3, range=0..10),
    BaseFSRFAR=Slider(1.561, range=0..10),
    TowerFSRFAR=Slider(1.63, range=0..10),
    MinimumAreaSiteCrv=Slider(2.718, range=0..5),
    MinimumAreaTowerCrv=Slider(4.49, range=0..5))  # -> OffsetCurve, BaseFloorCurves, TowerFloorCurves, PolyFromSubDivOfCrvs, FinalBoundaryRepresentation; disabled
crv_6 = Curve(courtyard_mass.OutputFloorCurves)
geo = Geometry(courtyard_mass.OutputMassingBreps)
panel = Panel(staggered_mass.OutputTextPanelTotalFSRGFAAchieved)
panel_2 = Panel(staggered_mass.NumberOfFloors)
geo_2 = Geometry(staggered_mass.OutputFloorCurves)
geo_3 = Geometry(block.OutputMassingBreps)
crv_7 = Curve(block.OutputFloorCurves)
geo_4 = Geometry(staggered_mass.OutputMassingBreps)
crv_8 = Curve(staggered_courtyard_normal.OffsetCurve)
crv_9 = Curve(staggered_courtyard_normal.BaseFloorCurves)
crv_10 = Curve(staggered_courtyard_normal.TowerFloorCurves)
crv_11 = Curve(staggered_courtyard_normal.PolyFromSubDivOfCrvs)
geo_5 = Geometry(staggered_courtyard_normal.FinalBoundaryRepresentation)
geo_6 = Geometry(staggered_courtyard_interp.FinalBoundaryRepresentation)
crv_12 = Curve(staggered_courtyard_interp.BaseFloorCurves)
crv_13 = Curve(staggered_courtyard_interp.OffsetCurve)
crv_14 = Curve(staggered_courtyard_interp.PolyFromSubDivOfCrvs)
crv_15 = Curve(staggered_courtyard_interp.TowerFloorCurves)
