# Grasshopper definition new_bsptest.gh (Grasshopper 1.0.7)
# plug-ins: DotsProj

path = FilePath("C:\nir_dev\MegaSavageLevel\DotsProjRh6\DotsProj\DotsProj\SourceCode\TEST_SCRIPTS\dots_workflow\coreInputs\GeomSample.csv")
path_2 = FilePath("C:\nir_dev\MegaSavageLevel\DotsProjRh6\DotsProj\DotsProj\SourceCode\TEST_SCRIPTS\dots_workflow\coreInputs\AdjSample.csv")
crv = Curve(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)
timer = Timer(TimerInterval=5000)  # disabled
bsp_solver = BSPSolver(
    InputADJACENCYFilePath=path_2,
    InputGEOMETRYFilePath=path,
    Site=crv,
    Sensitivity=Slider(3, range=3..100),
    RotationInDegrees=Slider(57, range=0..360),
    NumberOfIterations=Slider(15, range=0..100),
    ClearAllValues=Toggle(False),
    RandomizeAdjRels=Toggle(False),
    RunSolver=Toggle(True))  # -> DebugStr, Curves, CrvNames, PartitionLines
panel = Panel(bsp_solver.CrvNames)
crv_2 = Curve(bsp_solver.PartitionLines)
path_3 = FilePath("C:\nir_dev\MegaSavageLevel\DotsProjRh6\DotsProj\DotsProj\SourceCode\TEST_SCRIPTS\dots_workflow\coreInputs\colors2.csv")
color_input_parser = ColorInput(InpFilePath=path_3, ListSpaceKeysNames=bsp_solver.CrvNames, ListSpaceCrvs=bsp_solver.Curves)  # -> BrepFromCrvs, ColorStr
preview = CustomPreview(Geometry=color_input_parser.BrepFromCrvs, Material=color_input_parser.ColorStr)
