# Grasshopper definition siteFeasibility.gh (Grasshopper 1.0.7)
# plug-ins: DotsProj

crv = Curve([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])
path = FilePath("C:\nir_dev\MegaSavageLevel\DotsProjRh6\DotsProj\DotsProj\SourceCode\TEST_SCRIPTS\dots_workflow\inputs\siteFeasibility.csv")
crv_2 = Curve(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)
dist_solver = DistSolverMain(
    InputProximityFilePath=path,
    InputCurve=crv_2,
    InputCurveListForExclusion=crv,
    InputGridNumber=Slider(100, range=0..100),
    MaxIterationsToTry=Slider(100, range=0..500),
    Randomize=Toggle(False))  # -> OutputLocationsOfMassing, OutputSiteSequenceForMassing, KeySequence, Debug, Debug_2
crv_3 = Curve(dist_solver.Debug_2)
panel = Panel(dist_solver.Debug)
brep = Brep(dist_solver.OutputSiteSequenceForMassing)
panel_2 = Panel(dist_solver.KeySequence)
path_2 = FilePath("C:\nir_dev\MegaSavageLevel\DotsProjRh6\DotsProj\DotsProj\SourceCode\TEST_SCRIPTS\dots_workflow\inputs\colors.csv")
color_input_parser = ColorInput(InpFilePath=path_2, ListSpaceKeysNames=panel_2, ListSpaceCrvs=brep)  # -> BrepFromCrvs, ColorStr
block = MassingExtrudeBlock(
    SiteCurve=dist_solver.OutputSiteSequenceForMassing,
    Setback=Slider(1, range=0..15),
    FsrFar=Slider(3, range=0..15),
    FLRHT=Slider(3, range=0..15),
    MinCrvArea=Slider(15, range=0..15))  # -> OutputMassingBreps, OutputFloorCurves
preview = CustomPreview(Geometry=color_input_parser.BrepFromCrvs, Material=color_input_parser.ColorStr)
