# Grasshopper definition staggerredRect.gh (Grasshopper 1.0.7)
# plug-ins: DotsProj

number_slider = Slider(3.007, range=0..5)
crv = Curve(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)
staggered_courtyard_normal = StaggeredCourtyardNormal(
    Site=crv,
    Setback=Slider(1.659, range=0..5),
    BaseDepthOffset=Slider(7.258, range=0..9),
    NumOfTowerFootprintsBaseCrvSubdiv=Slider(7, range=0..50),
    NumberOfTowers=Slider(2, range=0..12),
    FloorFloorHeight=Slider(0.903, range=0..5),
    BaseFSRFAR=number_slider,
    TowerFSRFAR=number_slider,
    MinimumAreaSiteCrv=Slider(0, range=0..1),
    MinimumCourtyardArea=Slider(18.063, range=0..100))  # -> OffsetCurve, BaseFloorCurves, TowerFloorCurves, PolyFromSubDivOfCrvs, FinalBoundaryRepresentation
crv_2 = Curve(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)  # disabled
c_script = CSharpScript(crv=crv_2, di=Slider(8.66, range=0..25), numDiv=Slider(11, range=0..25))  # -> out, A, B, C; inputs crv: Curve, di: Double, numDiv: Int32; disabled
# ---------- c_script: C# ----------
    Curve outerCrv = crv.DuplicateCurve();
    Point3d P = AreaMassProperties.Compute(outerCrv).Centroid;
    Curve innerCrv = crv.Offset(P, Vector3d.ZAxis, di, 0.01, CurveOffsetCornerStyle.Smooth)[0];
    double[] innerCrvParams = innerCrv.DivideByCount(numDiv, true);

    List<Curve> lineLi = new List<Curve>();
    List<double> outerCrvParamLi = new List<double>();
    
    Polyline poly = new Polyline();
    bool t = innerCrv.TryGetPolyline(out poly);
    IEnumerator<Point3d> pts = poly.GetEnumerator();
    List<Point3d> tPtLi = new List<Point3d>();
    Rhino.Geometry.Plane pl = Plane.Unset;
    var t2 = Plane.FitPlaneToPoints(tPtLi, out pl);
    
    List<double> finnerCrvParams = new List<double>();
    List<double> fouterCrvParams = new List<double>();
    for(int i = 0; i < innerCrvParams.Length; i++){
      Point3d p = innerCrv.PointAt(innerCrvParams[i]);
      Vector3d u = innerCrv.TangentAt(innerCrvParams[i]);
      Point3d v = new Point3d(-u.Y, u.X, u.Z);
      // PointContainment cont = innerCrv.Contains(v, Plane.WorldXY, 0.01);
      PointContainment cont = innerCrv.Contains(v, pl, 0.01);
      if(cont.Equals(PointContainment.Inside) == false){
        v = new Point3d(u.Y, -u.X, u.Z);
      }
      double sc = Math.Sqrt(di) * 2;
      Point3d q = new Point3d(p.X + v.X * di * sc, p.Y + v.Y * di * sc, v.Z);
      LineCurve L = new LineCurve(p, q);

      var evts = Rhino.Geometry.Intersect.Intersection.CurveCurve(outerCrv, L, 0.01, 0.01);
      for(int j = 0; j < evts.Count; j++){
        var evt = evts[j];
        double paramA = evt.ParameterA;
        outerCrvParamLi.Add(paramA);
        // Point3d Q = outerCrv.PointAt(paramA);
        // ptLi.Add(Q);
        fouterCrvParams.Add(paramA);
        finnerCrvParams.Add(innerCrvParams[i]);
        break;
      }
      lineLi.Add(L);
    }
    double[] outerCrvParams = outerCrvParamLi.ToArray();
    Curve[] innerCrvSplit = innerCrv.Split(finnerCrvParams.ToArray());
    Curve[] outerCrvSplit = outerCrv.Split(fouterCrvParams.ToArray());

    List<Curve> crvLi = new List<Curve>();
    for(int i = 0; i < innerCrvSplit.Length; i++){
      Curve crvA = innerCrvSplit[i];
      Curve crvB = outerCrvSplit[i];
      Point3d p = crvA.PointAtStart;
      Point3d q = crvA.PointAtEnd;
      Point3d r = crvB.PointAtStart;
      Point3d s = crvB.PointAtEnd;
      Curve L = new LineCurve(p, r);
      Curve M = new LineCurve(q, s);
      List < Curve > crvLi2 = new List<Curve>{L, crvA, M, crvB};
      Curve crvX = Curve.JoinCurves(crvLi2)[0];
      crvLi.Add(crvX);
    }

    A = innerCrv;
    B = lineLi;
    C = crvLi;
# ---------- end c_script ----------
python = GhPythonScript(x=staggered_courtyard_normal.OffsetCurve)  # -> out, a
# ---------- python: Python ----------
__author__ = "Nirvik Saha"
__version__ = "2020.01.25"

import rhinoscriptsyntax as rs
a=rs.CurveArea(x)[0]
# ---------- end python ----------
geo = Geometry(c_script.C)
geo_2 = Geometry(c_script.B)
geo_3 = Geometry(c_script.A)
geo_4 = Geometry()
geo_5 = Geometry(staggered_courtyard_normal.OffsetCurve)
geo_6 = Geometry()
geo_7 = Geometry()
Z = UnitZ(Factor=Slider(7.271, range=0..25))
panel = Panel(python.a)
extr = Extrude(Base=geo_3, Direction=Z)
