# Grasshopper definition urban_plan_gen.gh (Grasshopper 1.0.7)
# plug-ins: DotsProj

crv = Curve(<curve referenced from the Rhino model>)  # disabled
parcel_subdiv = ParcelsBySubdivision(
    InputSite=crv,
    NumOfParcels=Slider(64, range=0..100),
    DevMean01=Slider(0.121, range=0..1),
    AngleAlignmentDegrees0360=Slider(360, range=0..360),
    ShowThisIterations=Slider(0, range=0..33),
    ResetAllValues=Toggle(True),
    Generate=Toggle(True))  # -> LowestDeviationOfParcelSolution, StreetCenterLines, OutputParcelFromRequiredIteration, OutputStreetFromRequiredIteration, NumberOfResults; disabled
crv_2 = Curve(parcel_subdiv.StreetCenterLines)
crv_3 = Curve(parcel_subdiv.OutputParcelFromRequiredIteration)
crv_4 = Curve(parcel_subdiv.LowestDeviationOfParcelSolution)
crv_5 = Curve(parcel_subdiv.OutputStreetFromRequiredIteration)
panel = Panel(parcel_subdiv.NumberOfResults)
circulation = GenerateCirculation(SiteCrvOuterBoundary=crv, CbspCrvs=crv_4, PartitionLines=crv_2, CirculationDepth=Slider(9, range=0..100))  # -> _0PartitionLines, _1CirculationPoly, _2ResultantCbspCrv; disabled
Z = UnitZ(Factor=Slider(0.397, range=0..10))
geo = Geometry(circulation._2ResultantCbspCrv)
brep = Brep(circulation._1CirculationPoly)
extr = Extrude(Base=geo, Direction=Z)
select = Select(
    InputSiteCrv=crv,
    Parcels=circulation._2ResultantCbspCrv,
    CentralizeOrDisperse=Toggle(False),
    OpenSpaceRequirement=Slider(34.299, range=0..100))  # -> OutputBuildableParcels, OutputOpenSpaceParcels; disabled
python = GhPythonScript(crvs=select.OutputBuildableParcels, min_ar=Slider(1500, range=0..1500))  # -> out, site_crvs, excluded_crvs; inputs crvs: list of Curve; disabled
# ---------- python: Python ----------
__author__ = "Nirvik Saha"
__version__ = "2020.01.24"

import rhinoscriptsyntax as rs

used_li=[]
excluded_li=[]

for c in crvs:
    ar=rs.CurveArea(c)[0]
    if(ar<min_ar):
        excluded_li.append(c)
    else:
        used_li.append(c)

site_crvs=used_li
excluded_crvs=excluded_li
# ---------- end python ----------
preview = CustomPreview(Geometry=brep, Material=ColourSwatch(SwatchColor=RGB(0, 0, 0)))
crv_6 = Curve(select.OutputOpenSpaceParcels)
courtyard_mass = CourtyardMassing(
    SiteCurve=crv_6,
    FSRFAR=Slider(0.937, range=0..4),
    FloorHeight=Slider(20, range=0..20),
    Setback=Slider(5.269, range=0..20),
    BayDepth=Slider(10.019, range=0..100),
    MinFloorArea=Slider(0, range=0..1500))  # -> OutputFloorCurves, OutputMassingBreps; disabled
brep_2 = Brep([crv_6, select.OutputBuildableParcels])
staggered_mass = StaggeredMassing(
    SiteCurve=python.site_crvs,
    FloorHeightRequired=Slider(6.71, range=0..20),
    SetbackStepbacksForMassing="7,12,15",
    HeightsCorrespondingToStepbacks="50,75, 25",
    MinArea=Slider(1500, range=0..1500))  # -> OutputFloorCurves, OutputMassingBreps, OutputTextPanelTotalFSRGFAAchieved, NumberOfFloors
Z_2 = UnitZ(Factor=1)
geo_2 = Geometry(courtyard_mass.OutputMassingBreps)
extr_2 = Extrude(Base=brep_2, Direction=Z_2)
geo_3 = Geometry(staggered_mass.OutputMassingBreps)
brep_3 = Brep(extr_2)
block = ExtrudeBlock(
    SiteCurve=python.excluded_crvs,
    Setback=Slider(1.27, range=0..20),
    FsrFar=Slider(5.541, range=0..20),
    FLRHT=Slider(3.029, range=0..20),
    MinCrvArea=Slider(252.7, range=0..1500))  # -> OutputExtrudedMass, FloorCurves
brep_4 = Brep(geo_2)
brep_5 = Brep(geo_3)
preview_2 = CustomPreview(Geometry=brep_3, Material=ColourSwatch(SwatchColor=RGB(0, 67, 17)))
preview_3 = CustomPreview(Geometry=brep_5, Material=ColourSwatch(SwatchColor=RGB(249, 150, 0)))
preview_4 = CustomPreview(Geometry=brep_4, Material=ColourSwatch(SwatchColor=RGB(0, 242, 242)))
geo_4 = Geometry(block.FloorCurves)
geo_5 = Geometry(block.OutputExtrudedMass)
brep_6 = Brep(geo_5)
preview_5 = CustomPreview(Geometry=brep_6, Material=ColourSwatch(SwatchColor=RGB(255, 4, 6)))

crv_7 = Curve(<curve referenced from the Rhino model>)  # disabled
parcel_subdiv_2 = ParcelsBySubdivision(
    InputSite=crv_7,
    NumOfParcels=Slider(64, range=0..100),
    DevMean01=Slider(0.121, range=0..1),
    AngleAlignmentDegrees0360=Slider(360, range=0..360),
    ShowThisIterations=Slider(0, range=0..33),
    ResetAllValues=Toggle(True),
    Generate=Toggle(True))  # -> LowestDeviationOfParcelSolution, StreetCenterLines, OutputParcelFromRequiredIteration, OutputStreetFromRequiredIteration, NumberOfResults; disabled
crv_8 = Curve(parcel_subdiv_2.StreetCenterLines)
crv_9 = Curve(parcel_subdiv_2.OutputParcelFromRequiredIteration)
crv_10 = Curve(parcel_subdiv_2.OutputStreetFromRequiredIteration)
crv_11 = Curve(parcel_subdiv_2.LowestDeviationOfParcelSolution)
panel_2 = Panel(parcel_subdiv_2.NumberOfResults)
circulation_2 = GenerateCirculation(SiteCrvOuterBoundary=crv_7, CbspCrvs=crv_11, PartitionLines=crv_8, CirculationDepth=Slider(9, range=0..100))  # -> _0PartitionLines, _1CirculationPoly, _2ResultantCbspCrv; disabled
geo_6 = Geometry(circulation_2._2ResultantCbspCrv)  # disabled
brep_7 = Brep()
Z_3 = UnitZ(Factor=1)
courtyard_mass_2 = CourtyardMassing(
    SiteCurve=geo_6,
    FSRFAR=Slider(3, range=0..20),
    FloorHeight=Slider(3, range=0..20),
    Setback=Slider(0.975, range=0..20),
    BayDepth=Slider(6.974, range=0..100),
    MinFloorArea=Slider(0, range=0..1500))  # -> OutputFloorCurves, OutputMassingBreps; disabled
extr_3 = Extrude(Base=brep_7, Direction=Z_3)
geo_7 = Geometry(courtyard_mass_2.OutputFloorCurves)
geo_8 = Geometry(courtyard_mass_2.OutputMassingBreps)

crv_12 = Curve(<curve referenced from the Rhino model>)
crv_13 = Curve(<curve referenced from the Rhino model>)
parcel_subdiv_diff = ParcelsBySubdivisionWithSubtraction(
    InputSite=crv_13,
    InternalCrv=crv_12,
    NumOfParcels=Slider(20, range=0..20),
    DevMean01=Slider(0, range=0..1),
    AngleAlignmentDegrees0360=Slider(0, range=0..360),
    ShowThisIterations=Slider(1, range=0..20),
    ResetAllValues=Toggle(True),
    Generate=Toggle(True))  # -> LowestDeviationOfParcelSolution, StreetCenterLines, OutputParcelFromRequiredIteration, OutputStreetFromRequiredIteration, NumberOfResults; disabled
crv_14 = Curve(parcel_subdiv_diff.LowestDeviationOfParcelSolution)
panel_3 = Panel(parcel_subdiv_diff.NumberOfResults)
crv_15 = Curve(parcel_subdiv_diff.OutputParcelFromRequiredIteration)
crv_16 = Curve(parcel_subdiv_diff.OutputStreetFromRequiredIteration)
crv_17 = Curve(parcel_subdiv_diff.StreetCenterLines)
Z_4 = UnitZ(Factor=Slider(4.209, range=0..10))
extr_4 = Extrude(Base=crv_14, Direction=Z_4)
brep_8 = Brep(crv_12)
brep_9 = Brep(extr_4)
circulation_3 = GenerateCirculation(SiteCrvOuterBoundary=crv_13, CbspCrvs=crv_14, PartitionLines=crv_17, CirculationDepth=Slider(15.502, range=0..20))  # -> _0PartitionLines, _1CirculationPoly, _2ResultantCbspCrv; disabled
preview_6 = CustomPreview(Geometry=brep_8, Material=ColourSwatch(SwatchColor=RGB(235, 7, 7)))
preview_7 = CustomPreview(Geometry=brep_9, Material=ColourSwatch(SwatchColor=RGB(0, 0, 0)))
brep_10 = Brep()
crv_18 = Curve(circulation_3._0PartitionLines)
crv_19 = Curve(circulation_3._2ResultantCbspCrv)
preview_8 = CustomPreview(Geometry=brep_10, Material=ColourSwatch(SwatchColor=RGB(196, 162, 98)))
staggered_mass_2 = StaggeredMassing(
    SiteCurve=crv_14,
    FloorHeightRequired=Slider(1.604, range=0..5),
    SetbackStepbacksForMassing="7,12",
    HeightsCorrespondingToStepbacks="20,50",
    MinArea=Slider(4.46, range=0..5))  # -> OutputFloorCurves, OutputMassingBreps, OutputTextPanelTotalFSRGFAAchieved, NumberOfFloors; disabled
geo_9 = Geometry(staggered_mass_2.OutputMassingBreps)

crv_20 = Curve(<curve referenced from the Rhino model>)  # disabled
peripheral_subdiv_parcel = PeripheralSubdivisionParcels(
    SiteCurve=crv_20,
    SetbackDimensionFromSite=Slider(9, range=0..20),
    BayDepthFromSetback=Slider(103, range=0..300),
    InnerCrv0ffsetFromBay=Slider(15, range=0..20),
    NumDiv=Slider(9, range=0..20))  # -> Setback, Bay, InnerCrv, ParcelCrv; disabled
number_slider = Slider(0, range=0..1)
crv_21 = Curve(peripheral_subdiv_parcel.ParcelCrv)
block_2 = ExtrudeBlock(
    SiteCurve=crv_21,
    Setback=Slider(15.316, range=0..20),
    FsrFar=Slider(20, range=0..20),
    FLRHT=Slider(5.827, range=0..20),
    MinCrvArea=Slider(0, range=0..20000))  # -> OutputExtrudedMass, FloorCurves
geo_10 = Geometry(block_2.OutputExtrudedMass)
geo_11 = Geometry(block_2.FloorCurves)  # disabled

crv_22 = Curve(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)  # disabled
crv_23 = Curve(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)  # disabled
Z_5 = UnitZ(Factor=Slider(20, range=0..20))
extr_5 = Extrude(Base=crv_22, Direction=Z_5)
parcel_int_poly = ParcelsFromInternalPoly(InputSiteCurve=crv_23, InternalPolyine=crv_22)  # -> OutputParcels, OutputStreets; disabled
Z_6 = UnitZ(Factor=Slider(4.209, range=0..10))
crv_24 = Curve(parcel_int_poly.OutputParcels)
crv_25 = Curve(parcel_int_poly.OutputStreets)
extr_6 = Extrude(Base=crv_24, Direction=Z_6)
brep_11 = Brep(extr_5)
brep_12 = Brep(extr_6)
preview_9 = CustomPreview(Geometry=brep_11, Material=ColourSwatch(SwatchColor=RGB(235, 7, 7)))
circulation_4 = GenerateCirculation(SiteCrvOuterBoundary=crv_23, CbspCrvs=crv_24, PartitionLines=crv_25, CirculationDepth=Slider(4.972, range=0..10))  # -> _0PartitionLines, _1CirculationPoly, _2ResultantCbspCrv; disabled
preview_10 = CustomPreview(Geometry=brep_12, Material=ColourSwatch(SwatchColor=RGB(0, 0, 0)))
brep_13 = Brep(crv_22)
block_3 = ExtrudeBlock(
    SiteCurve=crv_24,
    Setback=Slider(10.996, range=0..20),
    FsrFar=Slider(3.596, range=0..20),
    FLRHT=Slider(3.364, range=0..20),
    MinCrvArea=Slider(106.409, range=0..200))  # -> OutputExtrudedMass, FloorCurves; disabled
crv_26 = Curve(circulation_4._0PartitionLines)
crv_27 = Curve(circulation_4._2ResultantCbspCrv)
preview_11 = CustomPreview(Geometry=brep_13, Material=ColourSwatch(SwatchColor=RGB(196, 162, 98)))
geo_12 = Geometry(block_3.FloorCurves)
geo_13 = Geometry(block_3.OutputExtrudedMass)

crv_28 = Curve(<curve referenced from the Rhino model>)  # disabled
peripheral_subdiv_parcel_2 = PeripheralSubdivisionParcels(
    SiteCurve=crv_28,
    SetbackDimensionFromSite=Slider(6.685, range=0..10),
    BayDepthFromSetback=Slider(27.703, range=0..50),
    InnerCrv0ffsetFromBay=Slider(8.163, range=0..10),
    NumDiv=Slider(42, range=0..100))  # -> Setback, Bay, InnerCrv, ParcelCrv; disabled
Z_7 = UnitZ(Factor=Slider(4.209, range=0..10))
crv_29 = Curve(peripheral_subdiv_parcel_2.Setback)
crv_30 = Curve(peripheral_subdiv_parcel_2.Bay)
crv_31 = Curve(peripheral_subdiv_parcel_2.InnerCrv)
crv_32 = Curve(peripheral_subdiv_parcel_2.ParcelCrv)
extr_7 = Extrude(Base=crv_32, Direction=Z_7)
brep_14 = Brep(crv_32)
brep_15 = Brep(extr_7)
preview_12 = CustomPreview(Geometry=brep_14, Material=ColourSwatch(SwatchColor=RGB(202, 230, 220)))
preview_13 = CustomPreview(Geometry=brep_15, Material=ColourSwatch(SwatchColor=RGB(0, 0, 0)))
crv_33 = Curve(crv_32)
brep_16 = Brep(crv_31)
courtyard_mass_3 = CourtyardMassing(
    SiteCurve=crv_33,
    FSRFAR=Slider(2.198, range=0.5..3),
    FloorHeight=Slider(3, range=0..10),
    Setback=Slider(2.957, range=0..25),
    BayDepth=Slider(8, range=0..20),
    MaxHtFloorArea=Slider(0, range=0..20))  # -> OutputFloorCurves, OutputMassingBreps
preview_14 = CustomPreview(Geometry=brep_16, Material=ColourSwatch(SwatchColor=RGB(196, 162, 98)))

crv_34 = Curve(<curve referenced from the Rhino model>)  # disabled
peripheral_subdiv_parcel_3 = PeripheralSubdivisionParcels(
    SiteCurve=crv_34,
    SetbackDimensionFromSite=Slider(20, range=0..20),
    BayDepthFromSetback=Slider(34.534, range=0..50),
    InnerCrv0ffsetFromBay=Slider(10, range=0..10),
    NumDiv=Slider(40, range=0..100))  # -> Setback, Bay, InnerCrv, ParcelCrv; disabled
crv_35 = Curve(peripheral_subdiv_parcel_3.Setback)
crv_36 = Curve(peripheral_subdiv_parcel_3.Bay)
crv_37 = Curve(peripheral_subdiv_parcel_3.InnerCrv)
crv_38 = Curve(peripheral_subdiv_parcel_3.ParcelCrv)

number_slider_2 = Slider(0, range=0..1)
crv_39 = Curve(crv_38)  # disabled
block_4 = ExtrudeBlock(
    SiteCurve=crv_39,
    Setback=Slider(4.617, range=0..20),
    FsrFar=Slider(6.806, range=0..20),
    FLRHT=Slider(3, range=0..3),
    MinCrvArea=Slider(0, range=0..20000))  # -> OutputExtrudedMass, FloorCurves; disabled
geo_14 = Geometry(block_4.OutputExtrudedMass)
geo_15 = Geometry(block_4.FloorCurves)

crv_40 = Curve([<curve referenced from the Rhino model> x351])  # disabled
ext_setbacks = UrbanMassingFromSiteFsrSetbacksStreets(
    InputSiteCurves=crv_40,
    StreetLayerNames="streeta, streetb",
    CorrespondingStreetSetbacks="5.5, 7.0",
    InputFSR=Slider(15, range=0..15))  # -> OutputSolidGeometry, OutputSITENumbers; disabled
geo_16 = Geometry(ext_setbacks.OutputSolidGeometry)
panel_4 = Panel(ext_setbacks.OutputSITENumbers)

crv_41 = Curve(<curve referenced from the Rhino model>)  # disabled
peripheral_subdiv_parcel_4 = PeripheralSubdivisionParcels(
    SiteCurve=crv_41,
    SetbackDimensionFromSite=Slider(3, range=0..10),
    BayDepthFromSetback=Slider(47.407, range=0..50),
    InnerCrv0ffsetFromBay=Slider(1.573, range=0..10),
    NumDiv=Slider(15, range=0..100))  # -> Setback, Bay, InnerCrv, ParcelCrv; disabled
number_slider_3 = Slider(0, range=0..20)
crv_42 = Curve(peripheral_subdiv_parcel_4.Setback)
crv_43 = Curve(peripheral_subdiv_parcel_4.Bay)
crv_44 = Curve(peripheral_subdiv_parcel_4.InnerCrv)
crv_45 = Curve(peripheral_subdiv_parcel_4.ParcelCrv)
number_slider_4 = Slider(20, range=0..20)
number_slider_5 = Slider(4, range=0..20)
number_slider_6 = Slider(2.198, range=0.5..3)
number_slider_7 = Slider(9.613, range=0..25)
number_slider_8 = Slider(3, range=0..10)
number_slider_9 = Slider(0.149, range=0..10)
number_slider_10 = Slider(0.726, range=0..5)
crv_46 = Curve(crv_45)
staggered_courtyard_normal = StaggeredCourtyardNormal(
    Site=crv_46,
    Setback=number_slider_10,
    BaseDepthOffset=number_slider_7,
    NumOfTowerFootprintsBaseCrvSubdiv=number_slider_4,
    NumberOfTowers=number_slider_5,
    FloorFloorHeight=number_slider_8,
    BaseFSRFAR=number_slider_6,
    TowerFSRFAR=number_slider_9,
    MinimumAreaSiteCrv=number_slider_3,
    MinimumAreaTowerCrv=number_slider_3)  # -> OffsetCurve, BaseFloorCurves, TowerFloorCurves, PolyFromSubDivOfCrvs, FinalBoundaryRepresentation, FsrVals; disabled
staggered_courtyard_interp = StaggeredCourtyardInterpolated(
    Site=crv_46,
    Setback=number_slider_10,
    BaseDepthOffset=number_slider_7,
    BaseDepthOffset_2=number_slider_4,
    NumberOfTowers=number_slider_5,
    FloorFloorHeight=number_slider_8,
    BaseFSRFAR=number_slider_6,
    TowerFSRFAR=number_slider_9,
    MinimumAreaSiteCrv=number_slider_3,
    MinimumAreaTowerCrv=number_slider_3)  # -> OffsetCurve, BaseFloorCurves, TowerFloorCurves, PolyFromSubDivOfCrvs, FinalBoundaryRepresentation; disabled
geo_17 = Geometry(staggered_courtyard_normal.FinalBoundaryRepresentation)
geo_18 = Geometry(staggered_courtyard_interp.FinalBoundaryRepresentation)

geo_19 = Geometry([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])  # disabled
geo_20 = Geometry(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)  # disabled
site_partition_circulation = SitePartitionCirculation(
    SiteCurve=geo_20,
    CirculationCurve=geo_19,
    CirculationDepth=Slider(2.337, range=0..10),
    MinimumAreaPartition=Slider(106.142, range=0..1000))  # -> DebugText, CirculationCurves, PartitionCurves; disabled
number_slider_11 = Slider(2.208, range=0..5)
crv_47 = Curve(site_partition_circulation.CirculationCurves)
crv_48 = Curve(site_partition_circulation.PartitionCurves)
panel_5 = Panel(site_partition_circulation.DebugText)
block_5 = MassingExtrudeBlock(
    SiteCurve=crv_48,
    Setback=Slider(1.604, range=0..5),
    FsrFar=Slider(3.23, range=0..5),
    FLRHT=Slider(2.099, range=0..5),
    MinCrvArea=Slider(4.46, range=0..5))  # -> OutputMassingBreps, OutputFloorCurves
courtyard_mass_4 = CourtyardMassing(
    SiteCurve=crv_48,
    FSRFAR=Slider(1.604, range=0..5),
    FloorHeight=Slider(3.23, range=0..5),
    Setback=Slider(1.179, range=0..5),
    BayDepth=Slider(4.998, range=0..12),
    MinFloorArea=Slider(2.208, range=0..5))  # -> OutputFloorCurves, OutputMassingBreps; disabled
staggered_courtyard_normal_2 = StaggeredCourtyardNormal(
    Site=crv_48,
    Setback=Slider(1.604, range=0..5),
    BaseDepthOffset=Slider(3.23, range=0..5),
    NumOfTowerFootprintsBaseCrvSubdiv=Slider(10, range=0..10),
    NumberOfTowers=Slider(2, range=0..10),
    FloorFloorHeight=Slider(4.46, range=0..5),
    BaseFSRFAR=Slider(2.208, range=0..5),
    TowerFSRFAR=Slider(1.236, range=0..5),
    MinimumAreaSiteCrv=number_slider_11,
    MinimumAreaTowerCrv=number_slider_11)  # -> OffsetCurve, BaseFloorCurves, TowerFloorCurves, PolyFromSubDivOfCrvs, FinalBoundaryRepresentation, FsrVals; disabled

staggered_mass_3 = StaggeredMassing(
    SiteCurve=crv_48,
    FloorHeightRequired=Slider(1.604, range=0..5),
    SetbackStepbacksForMassing="3,5,7",
    HeightsCorrespondingToStepbacks="3,5,7",
    MinArea=Slider(4.46, range=0..5))  # -> OutputFloorCurves, OutputMassingBreps, OutputTextPanelTotalFSRGFAAchieved, NumberOfFloors; disabled

Z_8 = UnitZ(Factor=Slider(0.534, range=0..10))
extr_8 = Extrude(Base=geo_19, Direction=Z_8)
brep_17 = Brep(crv_48)
brep_18 = Brep(extr_8)
preview_15 = CustomPreview(Geometry=brep_17, Material=ColourSwatch(SwatchColor=RGB(232, 138, 23)))
preview_16 = CustomPreview(Geometry=brep_18, Material=ColourSwatch(SwatchColor=RGB(0, 0, 0)))
geo_21 = Geometry(courtyard_mass_4.OutputMassingBreps)
geo_22 = Geometry(block_5.OutputMassingBreps)
brep_19 = Brep(geo_22)
brep_20 = Brep(geo_21)
preview_17 = CustomPreview(Geometry=brep_19, Material=ColourSwatch(SwatchColor=RGB(0, 242, 242)))
preview_18 = CustomPreview(Geometry=brep_20, Material=ColourSwatch(SwatchColor=RGB(0, 242, 242)))
crv_49 = Curve(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)
python_2 = GhPythonScript()  # -> out, num_x, num_y
# ---------- python_2: Python ----------
__author__ = "Nirvik Saha"
__version__ = "2020.01.25"

import rhinoscriptsyntax as rs
import random

num_x=random.randint(3,7)
num_y=random.randint(3,7)
# ---------- end python_2 ----------
number_slider_12 = Slider(6, range=2..10)
number_slider_13 = Slider(5, range=2..10)
path = FilePath("C:\nir_dev\MegaSavageLevel\DotsProjRh6\DotsProj\DotsProj\SourceCode\TEST_SCRIPTS\dots_workflow\inputs\gridSA.csv")
grid_solver = GridAllocationSolver(
    InpFilePath=path,
    SiteCurve=crv_49,
    NumberXAxis=python_2.num_x,
    NumberYAxis=python_2.num_y,
    CirculationDepth=Slider(2, range=0..50),
    NumberOfIterations=Slider(2, range=0..50),
    MinimumAreaOfCurve=Slider(32, range=0..50))  # -> CrvNamesColor, ListOfFsr, Curve
Z_9 = UnitZ(Factor=Slider(0.999, range=0.999..1))
python_nums = GhPythonScript()  # -> out, a, b
# ---------- python_nums: Python ----------
__author__ = "Nirvik Saha"
__version__ = "2020.01.25"

import rhinoscriptsyntax as rs
import random

a=random.randint(5,10)
b=random.randint(3,a)

print(a,b)
# ---------- end python_nums ----------
brep_21 = Brep(grid_solver.Curve)
crv_select = CurveSelector()  # -> OutputBuildableParcels, OutputOpenSpaceParcels
python_fsr = GhPythonScript()  # -> out, base_fsr, tower_fsr
# ---------- python_fsr: Python ----------
__author__ = "Nirvik Saha"
__version__ = "2020.01.25"

import rhinoscriptsyntax as rs
import random

base_fsr=random.random()*3+1.5
tower_fsr=random.random()*5+1.5
# ---------- end python_fsr ----------
python_3 = GhPythonScript(crv=crv_49, setback=Slider(2.461, range=0..5))  # -> out, setback, base_depth
# ---------- python_3: Python ----------
__author__ = "Nirvik Saha"
__version__ = "2020.01.25"

import rhinoscriptsyntax as rs
import random

p=rs.CurveAreaCentroid(crv)[0]
b=rs.BoundingBox(crv)
li=[b[0],b[1],b[2],b[3],b[0]]
poly=rs.AddPolyline(li)
A=rs.Distance(b[0],b[1])
B=rs.Distance(b[1],b[2])
dx=(random.random()*A/7)+A/10
dy=(random.random()*B/7)+B/10
base_depth=min(dx,dy)/4
print(base_depth)
# ---------- end python_3 ----------
extr_9 = Extrude(Base=brep_21, Direction=Z_9)
preview_19 = CustomPreview(Geometry=extr_9, Material=ColourSwatch(SwatchColor=RGB(54, 110, 255)))
staggered_courtyard_normal_3 = StaggeredCourtyardNormal(
    Site=grid_solver.Curve,
    Setback=Slider(5, range=0..5),
    BaseDepthOffset=python_3.base_depth,
    NumOfTowerFootprintsBaseCrvSubdiv=python_nums.a,
    NumberOfTowers=python_nums.b,
    FloorFloorHeight=Slider(3, range=0..20),
    BaseFSRFAR=python_fsr.base_fsr,
    TowerFSRFAR=python_fsr.tower_fsr,
    MinimumAreaSiteCrv=Slider(0, range=0..1500),
    MinimumCourtyardArea=Slider(54.12, range=0..350))  # -> OffsetCurve, BaseFloorCurves, TowerFloorCurves, PolyFromSubDivOfCrvs, FinalBoundaryRepresentation, FsrVals
panel_6 = Panel(staggered_courtyard_normal_3.FsrVals)
geo_23 = Geometry(staggered_courtyard_normal_3.BaseFloorCurves)
preview_20 = CustomPreview(Geometry=staggered_courtyard_normal_3.FinalBoundaryRepresentation, Material=ColourSwatch(SwatchColor=RGB(239, 101, 0)))
brep_22 = Brep(staggered_courtyard_normal_3.OffsetCurve)
Z_10 = UnitZ(Factor=Slider(2, range=2..10))
extr_10 = Extrude(Base=brep_22, Direction=Z_10)
preview_21 = CustomPreview(Geometry=extr_10, Material=ColourSwatch(SwatchColor=RGB(0, 249, 0)))
