# Grasshopper definition test.gh (Grasshopper 1.0.7)
# plug-ins: DotsProj

number_slider = Slider(18, range=0..30)
number_slider_2 = Slider(1, range=1..10)
number_slider_3 = Slider(2, range=1..10)
geomsample = FilePath("C:\nir_dev\MegaSavageLevel\DotsProjRh6\DotsProj\DotsProj\bin\dots_workflow\jh_inputs\geomSample.csv")
crv = Curve(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)
# three-part solver
panel = Panel(geomsample)
gen_spaces_p = GenerateEqualPeripheralSpaces(
    InputGeometryFilePath=geomsample,
    InputSiteCurve=crv,
    FromSiteCurveOuterCirculationDepth=number_slider_2,
    FromOuterCirculationBayDepth=number_slider,
    FromBayDepthInnerCirculationDepth=number_slider_3)  # -> OutputCurves, OutputNames, DebugStr, OuterBayCrv, InnerBayCrv, InnerCirculationCrv; disabled
adjsample = FilePath("C:\nir_dev\MegaSavageLevel\DotsProjRh6\DotsProj\DotsProj\bin\dots_workflow\jh_inputs\adjSample.csv")
panel_2 = Panel(adjsample)
adj_solver = AdjSolver(
    InputAdjacencyFilePath=adjsample,
    ExistingCrvList=gen_spaces_p.OutputCurves,
    CorrespondingNameList=gen_spaces_p.OutputNames,
    NumberOfIterations=Slider(500, range=0..500),
    ClearPreviousValues=Toggle(True),
    RandomizeAdjRels=Toggle(False),
    RunSolver=Toggle(True))  # -> OutputCurves, OutputNames, MsgNumItrs
geom_solver_q = GeometrySolverPeripheral(
    InputGeometryFilePath=geomsample,
    InputSiteCurve=crv,
    CorrespondingNameList=adj_solver.OutputNames,
    FromSiteCurveOuterCirculationDepth=number_slider_2,
    FromOuterCirculationBayDepth=number_slider,
    FromBayDepthInnerCirculationDepth=number_slider_3,
    Sensitivity=Slider(500, range=0..500))  # -> OutputCurves, OutputNames, DebugStr, DebugOuter, DebugInner
colors = FilePath("C:\nir_dev\MegaSavageLevel\DotsProjRh6\DotsProj\DotsProj\bin\dots_workflow\jh_inputs\colors.csv")
color_input_parser = ColorInput(InpFilePath=colors, ListSpaceKeysNames=geom_solver_q.OutputNames, ListSpaceCrvs=geom_solver_q.OutputCurves)  # -> BrepFromCrvs, ColorStr
panel_3 = Panel(colors)
preview = CustomPreview(Geometry=color_input_parser.BrepFromCrvs, Material=color_input_parser.ColorStr)

# ----
# single component: High "sensitivity"
combined_geom_adj = FilePath("C:\nir_dev\MegaSavageLevel\DotsProjRh6\DotsProj\DotsProj\bin\dots_workflow\jh_inputs\combined_geom_adj.csv")
crv_2 = Curve(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)
panel_4 = Panel(combined_geom_adj)
crv_boundary = CrvBoundary(
    InpFilePath=combined_geom_adj,
    InpSiteCurve=crv_2,
    FromSiteOuterCirculationDepth=Slider(2, range=1..30),
    FromOuterCirculationBayDepth=Slider(14, range=0..50),
    FromBayDepthInnerCirculationDepth=Slider(10, range=0..10),
    SensitivityX100=Slider(1250, range=0..1250),
    OptimizationItrs=Slider(15000, range=0..15000))  # -> OuterOffsetCrv, InnerOffsetCrv, RESULTSegGeom, CrvNamesColor
colors_2 = FilePath("C:\nir_dev\MegaSavageLevel\DotsProjRh6\DotsProj\DotsProj\bin\dots_workflow\jh_inputs\colors.csv")
color_input_parser_2 = ColorInput(InpFilePath=colors_2, ListSpaceKeysNames=crv_boundary.CrvNamesColor, ListSpaceCrvs=crv_boundary.RESULTSegGeom)  # -> BrepFromCrvs, ColorStr
panel_5 = Panel(colors_2)
preview_2 = CustomPreview(Geometry=color_input_parser_2.BrepFromCrvs, Material=color_input_parser_2.ColorStr)
