# Grasshopper definition attractor.gh (Grasshopper 1.0.7)
# plug-ins: DotsProj

curve = Curve(<curve referenced from the Rhino model>)
parcels_by_subdivision = ParcelsBySubdivision(
    InputSite=curve,
    NumberParcels=Slider(83, range=5..100),
    DevDim01=0,
    AngleAlignmentDegrees0360=0,
    ShowThisIterations=0,
    ResetAllValues=True,
    Generate=True)  # -> LowestDeviationOfParcelSolution, StreetCenterLines, OutputParcelFromRequiredIteration, OutputStreetFromRequiredIteration, NumberOfResults
point = Point([Point(-108.1281014, 254.5178088, 0), Point(114.915453, -315.0211815, 0)])
gen_hts_from_pts = GenHtsFromPts(
    InputParcelList=parcels_by_subdivision.LowestDeviationOfParcelSolution,
    InputPointList=point,
    MultiplierCoefficient=1,
    OPTTrueHighIfCloseFalseLowIfClose=Toggle(True),
    MinValForInterpolation=Slider(0.324, range=0.1..2),
    MaxValForInterpolation=Slider(62.643, range=0.1..100))  # -> HtLi, DebugTxt
ghpython_script = GhPythonScript(Crvs=parcels_by_subdivision.LowestDeviationOfParcelSolution, Pts=point)  # -> Out, A
massing_extrude_block = MassingExtrudeBlock(
    SiteCurve=parcels_by_subdivision.LowestDeviationOfParcelSolution,
    Setback=Slider(7.025, range=2.999..10),
    FSR=gen_hts_from_pts.HtLi,
    FLRHT=3,
    MinCrvArea=Slider(369.288, range=2.999..500),
    NameOptional="dots")  # -> OutputMassingBreps, OutputFloorCurves, Name
panel = Panel(gen_hts_from_pts.HtLi)
custom_preview = CustomPreview(Geometry=massing_extrude_block.OutputMassingBreps, Material=ColourSwatch(SwatchColor=RGB(255, 255, 255)))
