# Grasshopper definition db.gh (Grasshopper 1.0.7)
# plug-ins: DotsProj, DotsDBProj

# ----
# independent module
# for space allocation
number_slider = Slider(40, range=0..360)
path = FilePath("C:\nir_dev\MegaSavageLevel\DotsProjRh6\DotsProj\DotsProj\bin\example_Files\inputs\sample1.csv")
cbsp = CbspIndependent(
    InputFilesCsv=path,
    RotationInDegrees=number_slider,
    RatioLengthWidth=Slider(0.425, range=0..3),
    RandomizedGenerations=Toggle(False),
    NumberOfOptimizationLoops=Slider(28, range=0..250))  # -> OuterBoundary, BspOutputCurves, PartitionLines, CrvNamesColor
crv = Curve(cbsp.OuterBoundary)

# ----
# circulation
number_slider_2 = Slider(0.07, range=0..1)
circulation = GenerateCirculation(
    SiteCrvOuterBoundary=cbsp.OuterBoundary,
    CbspCrvs=cbsp.BspOutputCurves,
    PartitionLines=cbsp.PartitionLines,
    CirculationDepth=number_slider_2)  # -> _0PartitionLines, _1CirculationPoly, _2ResultantCbspCrv

python = GhPythonScript()  # -> out, a
# ---------- python: Python ----------
__author__ = "Nirvik Saha"
__version__ = "2020.04.16"

import rhinoscriptsyntax as rs

a=['a','b','c']
# ---------- end python ----------
crv_2 = Curve([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])
send_db = DotsDBProj(
    InputCurves=circulation._2ResultantCbspCrv,
    NameOfTheCollection="test23",
    KeyName=cbsp.CrvNamesColor,
    WriteToDbTF=Toggle(False))  # -> DebugStr, SendInfoToDB

# ----
# color
path_2 = FilePath("C:\nir_dev\MegaSavageLevel\DotsProjRh6\DotsProj\DotsProj\bin\example_Files\inputs\colors.csv")
color_input_parser = ColorInput(InpFilePath=path_2, ListSpaceKeysNames=cbsp.CrvNamesColor, ListSpaceCrvs=circulation._2ResultantCbspCrv)  # -> BrepFromCrvs, ColorStr
Z = UnitZ(Factor=Slider(0.013, range=0..1))
extr = Extrude(Base=color_input_parser.BrepFromCrvs, Direction=Z)
preview = CustomPreview(Geometry=extr, Material=color_input_parser.ColorStr)

panel = Panel(send_db.DebugStr)
panel_2 = Panel(send_db.SendInfoToDB)
