# Grasshopper definition dots_00_SA_basic.gh (Grasshopper 1.0.7)
# plug-ins: DotsProj

# ----
# fit spaces along a curve - periphery
# for space allocation
number_slider = Slider(3.784, range=0..20)
# constructs floor plan around periphery of a given curve
path = FilePath("C:\nir_dev\MegaSavageLevel\DOTS\DotsProj\bin\example_Files\inputs\sample1.csv")
crv = Curve(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)
crv_boundary = CrvBoundary(
    InpFilePath=path,
    InpSiteCurve=crv,
    FromSiteOuterCirculationDepth=Slider(1.512, range=0..20),
    FromOuterCirculationBayDepth=Slider(12.272, range=0..20),
    FromBayDepthInnerCirculationDepth=number_slider,
    SensitivityX100=Slider(1, range=0..10),
    OptimizationItrs=Slider(0, range=0..100))  # -> OuterOffsetCrv, InnerOffsetCrv, RESULTSegGeom, CrvNamesColor

# ----
# constructs floor plan within a given curve
# fit spaces inside a curve
# for space allocation
path_2 = FilePath("C:\nir_dev\MegaSavageLevel\DOTS\DotsProj\bin\example_Files\inputs\sample1.csv")
crv_2 = Curve(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)
cbsp_site = CbspSite(
    InputFilesCsv=path_2,
    InputSiteCrv=crv_2,
    RotationInDegrees=Slider(0, range=0..360),
    RandomizedGenerations=Toggle(False),
    MinDev=Slider(0, range=0..3),
    NumberOfOptimizationLoops=Slider(0.62, range=0..3),
    LayerName="a")  # -> SpatialCrv, CirculationLines, CrvNamesColor

# ----
# spaces along the periphery
number_slider_2 = Slider(2.245, range=0..5)
# Combined: (i) constructs floor plan around periphery of a given curve (ii) Internal subdivision
path_3 = FilePath("C:\nir_dev\MegaSavageLevel\DOTS\DotsProj\bin\example_Files\inputs\sample1.csv")
crv_3 = Curve(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)
crv_boundary_2 = CrvBoundary(
    InpFilePath=path_3,
    InpSiteCurve=crv_3,
    FromSiteOuterCirculationDepth=Slider(1.241, range=0..20),
    FromOuterCirculationBayDepth=Slider(3.494, range=0..10),
    FromBayDepthInnerCirculationDepth=number_slider_2,
    SensitivityX100=Slider(4, range=0..10),
    OptimizationItrs=Slider(0, range=0..100))  # -> OuterOffsetCrv, InnerOffsetCrv, RESULTSegGeom, CrvNamesColor

# ----
# circulation
number_slider_3 = Slider(0.07, range=0..1)
circulation = GenerateCirculation(
    SiteCrvOuterBoundary=crv_2,
    CbspCrvs=cbsp_site.SpatialCrv,
    PartitionLines=cbsp_site.CirculationLines,
    CirculationDepth=number_slider_3)  # -> _0PartitionLines, _1CirculationPoly, _2ResultantCbspCrv

curve = Curve(crv_boundary_2.InnerOffsetCrv)

# ----
# spaces inside the inner curve
path_4 = FilePath("C:\nir_dev\MegaSavageLevel\DOTS\DotsProj\bin\example_Files\inputs\sample1.csv")
cbsp_site_2 = CbspSite(
    InputFilesCsv=path_4,
    InputSiteCrv=crv_boundary_2.InnerOffsetCrv,
    RotationInDegrees=Slider(0, range=0..360),
    RandomizedGenerations=Toggle(False),
    MinDev=Slider(0.62, range=0..3),
    NumberOfOptimizationLoops=Slider(0.62, range=0..3),
    LayerName="a")  # -> SpatialCrv, CirculationLines, CrvNamesColor

curve_2 = Curve(circulation._2ResultantCbspCrv)

# ----
# color - peripheral
path_5 = FilePath("C:\nir_dev\MegaSavageLevel\DOTS\DotsProj\bin\example_Files\inputs\colors.csv")
color_input_parser = ColorInput(InpFilePath=path_5, ListSpaceKeysNames=crv_boundary_2.CrvNamesColor, ListSpaceCrvs=crv_boundary_2.RESULTSegGeom)  # -> BrepFromCrvs, ColorStr
Z = UnitZ(Factor=Slider(0.053, range=0..1))
extr = Extrude(Base=color_input_parser.BrepFromCrvs, Direction=Z)
preview = CustomPreview(Geometry=extr, Material=color_input_parser.ColorStr)

# ----
# color
path_6 = FilePath("C:\nir_dev\MegaSavageLevel\DOTS\DotsProj\bin\example_Files\inputs\colors.csv")
color_input_parser_2 = ColorInput(InpFilePath=path_6, ListSpaceKeysNames=cbsp_site.CrvNamesColor, ListSpaceCrvs=curve_2)  # -> BrepFromCrvs, ColorStr
Z_2 = UnitZ(Factor=Slider(0.015, range=0..1))
extr_2 = Extrude(Base=color_input_parser_2.BrepFromCrvs, Direction=Z_2)
preview_2 = CustomPreview(Geometry=extr_2, Material=color_input_parser_2.ColorStr)

# ----
# color
path_7 = FilePath("C:\nir_dev\MegaSavageLevel\DOTS\DotsProj\bin\example_Files\inputs\colors.csv")
color_input_parser_3 = ColorInput(InpFilePath=path_7, ListSpaceKeysNames=crv_boundary.CrvNamesColor, ListSpaceCrvs=crv_boundary.RESULTSegGeom)  # -> BrepFromCrvs, ColorStr
Z_3 = UnitZ(Factor=Slider(0.038, range=0..1))
extr_3 = Extrude(Base=color_input_parser_3.BrepFromCrvs, Direction=Z_3)
preview_3 = CustomPreview(Geometry=extr_3, Material=color_input_parser_3.ColorStr)

# ----
# circulation
number_slider_4 = Slider(0.835, range=0..10)
circulation_2 = GenerateCirculation(
    SiteCrvOuterBoundary=crv_boundary_2.InnerOffsetCrv,
    CbspCrvs=cbsp_site_2.SpatialCrv,
    PartitionLines=cbsp_site_2.CirculationLines,
    CirculationDepth=number_slider_4)  # -> _0PartitionLines, _1CirculationPoly, _2ResultantCbspCrv

# ----
# color
path_8 = FilePath("C:\nir_dev\MegaSavageLevel\DOTS\DotsProj\bin\example_Files\inputs\colors.csv")
Z_4 = UnitZ(Factor=Slider(0.053, range=0..1))

color_input = ColorInput(InpFilePath=path_8, ListSpaceKeysNames=cbsp_site_2.CrvNamesColor, ListSpaceCrvs=circulation_2._2ResultantCbspCrv)  # -> BrepFromCrvs, ColorStr

extr_4 = Extrude(Base=color_input.BrepFromCrvs, Direction=Z_4)
preview_4 = CustomPreview(Geometry=extr_4, Material=color_input.ColorStr)
