# Grasshopper definition dots_util_00.gh (Grasshopper 1.0.7)
# plug-ins: DotsProj

crv = Curve(<curve referenced from the Rhino model>)
parcel_subdiv = ParcelsBySubdivision(
    InputSite=crv,
    NumOfParcels=Slider(100, range=0..100),
    DevMean01=Slider(0.149, range=0..1),
    AngleAlignmentDegrees0360=Slider(0, range=0..360),
    ShowThisIterations=Slider(0, range=0..360),
    ResetAllValues=Toggle(True),
    Generate=Toggle(True))  # -> LowestDeviationOfParcelSolution, StreetCenterLines, OutputParcelFromRequiredIteration, OutputStreetFromRequiredIteration, NumberOfResults
geo = Geometry(parcel_subdiv.LowestDeviationOfParcelSolution)
crv_select = CurveSelector(
    InputSiteCrv=crv,
    Parcels=parcel_subdiv.LowestDeviationOfParcelSolution,
    CentralizeOrDisperse=Toggle(False),
    AreaOfCurvesToSplitListInto=Slider(53.405, range=0..100))  # -> OutputListOfParcels1, OutputListOfParcels2
brep = Brep(crv_select.OutputListOfParcels1)
brep_2 = Brep(crv_select.OutputListOfParcels2)
preview = CustomPreview(Geometry=brep_2, Material=ColourSwatch(SwatchColor=RGB(16, 232, 255)))
preview_2 = CustomPreview(Geometry=brep, Material=ColourSwatch(SwatchColor=RGB(230, 37, 255)))
staggered_mass = StaggeredMassing(
    SiteCurve=crv_select.OutputListOfParcels2,
    FloorHeightRequired=Slider(5.86, range=0..25),
    SetbackStepbacksForMassing="2",
    HeightsCorrespondingToStepbacks="20",
    MinArea=Slider(0, range=0..5000),
    NameOptional="v")  # -> OutputFloorCurves, OutputMassingBreps, OutputTextPanelTotalFSRGFAAchieved, NumberOfFloors, ExcludedCrv, Name
block = MassingExtrudeBlock(
    SiteCurve=crv_select.OutputListOfParcels1,
    Setback=Slider(5.336, range=0..25),
    FsrFar=Slider(3, range=0..25),
    FLRHT=Slider(5, range=0..5),
    MinCrvArea=Slider(50, range=0..50),
    NameOptional="a")  # -> OutputMassingBreps, OutputFloorCurves, Name
preview_3 = CustomPreview(Geometry=staggered_mass.OutputMassingBreps, Material=ColourSwatch(SwatchColor=RGB(237, 58, 17)))
preview_4 = CustomPreview(Geometry=block.OutputMassingBreps, Material=ColourSwatch(SwatchColor=RGB(41, 169, 17)))
