# Grasshopper definition test.gh (Grasshopper 1.0.7)
# plug-ins: DotsProj

panel = Panel("example_Files\inputs\gridSA.csv")
path = FilePath("C:\nir_dev\MegaSavageLevel\DOTS\DotsProj\bin\example_Files\inputs\gridSA.csv")
crv = Curve(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)
grid_allocation_solver = GridAllocationSolver(
    InpFilePath=path,
    SiteCurve=crv,
    NumberXAxis=Slider(4, range=1..5),
    NumberYAxis=Slider(4, range=1..5),
    CirculationDepth=Slider(1, range=1..5),
    NumberOfIterations=Slider(16, range=1..50),
    MinimumAreaOfCurve=Slider(20, range=0..20))  # -> CrvNamesColor, ListOfFsr, Curve, Debug
path_2 = FilePath("C:\nir_dev\MegaSavageLevel\DOTS\DotsProj\bin\example_Files\inputs\colors.csv")
panel_2 = Panel("a")
color_input_parser = ColorInput(InpFilePath=path_2, ListSpaceKeysNames=grid_allocation_solver.CrvNamesColor, ListSpaceCrvs=grid_allocation_solver.Curve)  # -> BrepFromCrvs, ColorStr
block = MassingExtrudeBlock(
    SiteCurve=grid_allocation_solver.Curve,
    Setback=Slider(2, range=1..5),
    FsrFar=grid_allocation_solver.ListOfFsr,
    FLRHT=Slider(5, range=1..5),
    MinCrvArea=Slider(5, range=1..5),
    NameOptional="a")  # -> OutputMassingBreps, OutputFloorCurves, Name
preview = CustomPreview(Geometry=color_input_parser.BrepFromCrvs, Material=color_input_parser.ColorStr)
