# Grasshopper definition test.gh (Grasshopper 1.0.7)
# plug-ins: DotsProj

flr_ht = Slider(3, range=1..5)
number_of_partitions = Slider(1, range=1..10)
number_courtyard_blocks = Slider(3, range=0..5)
setback = Slider(5, range=1..5)
panel = Panel("http://127.0.0.1:5000/api/get/partitions")
panel_2 = Panel("https://apipw2.azurewebsites.net/api/get/partitions")
panel_3 = Panel("https://apipw2.azurewebsites.net/api/get/partitions")  # disabled
panel_4 = Panel("http://127.0.0.1:5000/api/post/partitions")  # disabled
courtyard_block_depth = Slider(15, range=1..15)
flr_ht_2 = Slider(3, range=1..5)
setback_2 = Slider(9, range=1..50)
run_or_not = BooleanToggle(False)
peripheral_depth = Slider(46, range=1..100)
fsr = Slider(3, range=1..5)
flr_ht_3 = Slider(4, range=1..5)  # disabled
setback_3 = Slider(9, range=1..50)  # disabled
peripheral_depth_2 = Slider(77, range=1..100)
fsr_2 = Slider(3, range=1..5)
peripheral_depth_3 = Slider(5, range=1..10)  # disabled
fsr_3 = Slider(5, range=1..5)  # disabled
number_slider = Slider(0.5, range=0..1)  # disabled
run_or_not_2 = BooleanToggle(True)
curve = Curve(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)
run_or_not_3 = BooleanToggle(True)  # disabled
curve_2 = Curve(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)
curve_3 = Curve(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)
curve_4 = Curve(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)  # disabled
typologysystem = TypologySystem(
    SiteCurve=curve_2,
    Type="courtyard",
    Fsr=Slider(1.511, range=1..5),
    FloorHeight=Slider(3, range=1..5),
    Length=Slider(100, range=1..100),
    Width=Slider(100, range=1..100),
    Dist=Slider(13, range=1..100),
    AngleOfRotation0360=Slider(89, range=1..100),
    RotateFromCenter=Toggle(True),
    RunOrNot=Toggle(True))  # -> DataSentInputs, Site, TypologyFootprints, FloorCurves, Mass
peripheralpartitions = PeripheralPartitions(
    SiteCurve=curve,
    Url="https://apipw2.azurewebsites.net/api/get/partitions",
    NumberOfPartitions=number_of_partitions,
    FloorSpaceRatio=fsr,
    FloorHeight=flr_ht,
    PeripheralDepth=peripheral_depth,
    Setback=setback,
    CourtyardBlockDepth=courtyard_block_depth,
    NumberOfCourtyardBlocks=number_courtyard_blocks,
    RunOrNot=run_or_not)  # -> Debug, DataObj, Parcels, Footprints, BuildingMassBlock, BuildingMassCourtyard; disabled
peripheralsysmain = PeripheralSysMain(
    SiteCurve=curve_3,
    Url="http://127.0.0.1:5000/api/post/peripheral",
    FloorSpaceRatio=fsr_2,
    FloorHeight=flr_ht_2,
    PeripheralDepth=peripheral_depth_2,
    Setback=setback_2,
    RunOrNot=run_or_not_2)  # -> DataSentInputs, DataObj, Parcels, Footprints, BuildingMassBlock, BuildingMassCourtyard; disabled
partitionsysmain = PartitionSysMain(
    SiteCurve=curve_4,
    Url=panel_4,
    FloorSpaceRatio=fsr_3,
    FloorHeight=flr_ht_3,
    NumberOfPartitions=peripheral_depth_3,
    Setback=setback_3,
    Randomize=number_slider,
    RunOrNot=run_or_not_3)  # -> DataSentInputs, DataObj, Parcels, Footprints, BuildingMassBlock, BuildingMassCourtyard; disabled
geometry = Geometry(typologysystem.Site)
geometry_2 = Geometry(typologysystem.TypologyFootprints)
geometry_3 = Geometry(typologysystem.Mass)
geometry_4 = Geometry()  # disabled
geometry_5 = Geometry(typologysystem.FloorCurves)
panel_5 = Panel(typologysystem.DataSentInputs)
geometry_6 = Geometry(peripheralsysmain.BuildingMassBlock)
geometry_7 = Geometry(peripheralsysmain.Footprints)
geometry_8 = Geometry(peripheralsysmain.Parcels)
panel_6 = Panel(peripheralsysmain.DataSentInputs)
number_slider_2 = Slider(6, range=1..10)  # disabled
panel_7 = Panel(peripheralpartitions.Debug)
panel_8 = Panel(peripheralpartitions.DataObj)
geometry_9 = Geometry(peripheralpartitions.Parcels)
geometry_10 = Geometry(peripheralpartitions.Footprints)
geometry_11 = Geometry(peripheralpartitions.BuildingMassCourtyard)
geometry_12 = Geometry(peripheralpartitions.BuildingMassBlock)
panel_9 = Panel("http://127.0.0.1:5000/api/post/peripheral")  # disabled
geometry_13 = Geometry(partitionsysmain.Parcels)  # disabled
flr_ht_4 = Slider(3, range=1..5)  # disabled
setback_4 = Slider(8, range=1..50)  # disabled
peripheral_depth_4 = Slider(95, range=1..100)  # disabled
fsr_4 = Slider(3, range=1..5)  # disabled
list_item = ListItem(List=geometry_13, Index=number_slider_2, Wrap=True)  # disabled
run_or_not_4 = BooleanToggle(True)  # disabled
curve_5 = Curve(list_item)  # disabled
peripheralsysmain_2 = PeripheralSysMain(
    SiteCurve=geometry_13,
    Url=panel_9,
    FloorSpaceRatio=fsr_4,
    FloorHeight=flr_ht_4,
    PeripheralDepth=peripheral_depth_4,
    Setback=setback_4,
    RunOrNot=run_or_not_4)  # -> DataSentInputs, DataObj, Parcels, Footprints, BuildingMassBlock, BuildingMassCourtyard; disabled
geometry_14 = Geometry(peripheralsysmain_2.BuildingMassBlock)  # disabled
geometry_15 = Geometry(peripheralsysmain_2.Footprints)  # disabled
geometry_16 = Geometry(peripheralsysmain_2.Parcels)  # disabled
panel_10 = Panel(peripheralsysmain_2.DataSentInputs)  # disabled
